# Dynamo graph MM - Change Link to Halftone.dyn (Dynamo 2.12.0.5650)
# packages: DynamoDots 2020.1.3

getAllViews = Custom[GetAllViews]()  # package DynamoDots
set_links_to_halftone_in_all = Python()  # "Set links to halftone in all views"; IronPython2; unwired: IN[0]
# ---------- set_links_to_halftone_in_all.python (36 lines) ----------
import clr
import System

clr.AddReference("RevitServices")
import RevitServices
from RevitServices.Persistence import DocumentManager
from RevitServices.Transactions import TransactionManager
doc = DocumentManager.Instance.CurrentDBDocument

clr.AddReference("RevitAPI")
import Autodesk
from Autodesk.Revit.DB import *

clr.AddReference("RevitNodes")
import Revit
clr.ImportExtensions(Revit.Elements)
clr.ImportExtensions(Revit.GeometryConversion)

viewElems = FilteredElementCollector(doc).OfCategory(BuiltInCategory.OST_Views).WhereElementIsNotElementType().ToElements()

linkInstance = FilteredElementCollector(doc).OfClass(RevitLinkInstance).WhereElementIsNotElementType().ToElementIds()


oGS = OverrideGraphicSettings().SetHalftone(True)

TransactionManager.Instance.EnsureInTransaction(doc)    
#try:
for vE in viewElems:
    for lI in linkInstance:
        vE.SetElementOverrides(lI, oGS)
#except Exception as e:
#    OUT = 'Failed to override' + str(e) 
    
TransactionManager.Instance.TransactionTaskDone()
# Assign your output to the OUT variable.
OUT = "Success"
# ----------------------------------------
