# Dynamo graph MM - Create Worksets.dyn (Dynamo 2.0.4.12684)

worksets = WorksetUi(index=30)
name = archilab.Revit.Elements.Workset.Name(workset=worksets)
string = StringInput("  - Recopy Hidden ")
add = name + string
byName = archilab.Revit.Elements.Workset.ByName(name=add)
