# Dynamo graph MM - Family Swap Generic.dyn (Dynamo 2.0.4.12684)

family_types = FamilyTypes(index=526)
byFamilyType = FamilyInstance.ByFamilyType(familyType=family_types)
code_link = CodeBlock { "EX_Elec_Dim_Depth"; }
getParameterValueByName = Element.GetParameterValueByName(element=byFamilyType, parameterName=code_link)
code_block = CodeBlock(passthrough=byFamilyType, waitfor=getParameterValueByName) { [passthrough,waitfor][0]; }
code_block_2 = CodeBlock { "Family"; }
family_types_2 = FamilyTypes(index=524)
setParameterByName = Element.SetParameterByName(element=code_block, parameterName=code_block_2, value=family_types_2)
setParameterByName_2 = Element.SetParameterByName(element=code_block, parameterName=code_link, value=getParameterValueByName)
code_link_2 = CodeBlock { "EX_Elec_Dim_Height"; }
getParameterValueByName_2 = Element.GetParameterValueByName(element=byFamilyType, parameterName=code_link_2)
setParameterByName_3 = Element.SetParameterByName(element=code_block, parameterName=code_link_2, value=getParameterValueByName_2)
code_link_3 = CodeBlock { "EX_Elec_Dim_Length"; }
getParameterValueByName_3 = Element.GetParameterValueByName(element=byFamilyType, parameterName=code_link_3)
setParameterByName_4 = Element.SetParameterByName(element=code_block, parameterName=code_link_3, value=getParameterValueByName_3)
code_link_4 = CodeBlock { "Offset"; }
getParameterValueByName_4 = Element.GetParameterValueByName(element=byFamilyType, parameterName=code_link_4)
setParameterByName_5 = Element.SetParameterByName(element=code_block, parameterName=code_link_4, value=getParameterValueByName_4)
