# Dynamo graph MM - Python - Add SheetNumber to Placed Views.dyn "FTI - Python - Add SheetNumber to Placed Views" (Dynamo 2.6.1.8786)

append_sheetnumber_to_placed = Python()  # "Append SheetNumber to Placed Views"; unwired: IN[0]
# ---------- append_sheetnumber_to_placed.python (68 lines) ----------
import clr
import sys
pyPath = r"C:\Program Files (x86)\IronPython 2.7\Lib"
sys.path.append(pyPath)
import os
import System 
import System.Collections

#Access to Revit Document
clr.AddReference("RevitServices")
import RevitServices

#To Get Doc, UI and Application Objects

from RevitServices.Persistence import DocumentManager
doc = DocumentManager.Instance.CurrentDBDocument
uidoc = DocumentManager.Instance.CurrentUIDocument
app = DocumentManager.Instance.CurrentUIApplication.Application

#Needed to make any changes in Revit
from RevitServices.Transactions import TransactionManager

clr.AddReference("RevitNodes")
import Revit
clr.ImportExtensions(Revit.Elements)

clr.AddReference("RevitAPI")
from Autodesk.Revit.DB import *;

clr.AddReference("RevitAPIUI")
from Autodesk.Revit.UI import *




pVN = []
pVNUnique = []
pVElems = []


sheets = FilteredElementCollector(doc).OfCategory(BuiltInCategory.OST_Sheets).WhereElementIsNotElementType().ToElements()
try:
	for s in sheets:
		sNumber = s.SheetNumber.ToString()
		placedViews = s.GetAllPlacedViews()
		for sublist in placedViews:
			if sublist not in pVNUnique:
				pVNUnique.append(sublist)
				for pV in pVNUnique:
					pVElem = doc.GetElement(pV)
					pVNames = pVElem.Name
					pVN.append(pVNames)
					pVRefDetail = pVElem.LookupParameter("Detail Number").AsString()
				if not pVNames.StartsWith(sNumber):
					if pVRefDetail != "-":
						TransactionManager.Instance.EnsureInTransaction(doc)
						pVElem.LookupParameter("View Name").Set(sNumber + " - " + pVRefDetail + " - " + pVNames)
						TransactionManager.Instance.EnsureInTransaction(doc)
					else:
						TransactionManager.Instance.EnsureInTransaction(doc)
						pVElem.LookupParameter("View Name").Set(sNumber + " - " + pVNames)
						TransactionManager.Instance.EnsureInTransaction(doc)
except:
	OUT = "Failed, Please verify sheets have placed views"
	
		

OUT =  "Success"
# ----------------------------------------
