# Dynamo graph MM - Python - Assign Parameter Info by Scope Box.dyn "MPM - Python - Assign Parameter Info by Scope Box" (Dynamo 2.3.2.15696)

manual_refresh = BoolSelector(true)
parameter_to_name = StringInput("HEC_Area")  # graph input
scope_box_name_contains = StringInput("AREA")  # graph input
scope_box_assign_parameter = Python(IN[0]=manual_refresh, IN[1]=parameter_to_name, IN[2]=scope_box_name_contains)
# ---------- scope_box_assign_parameter.python (66 lines) ----------
import clr
clr.AddReference('RevitAPI')
from Autodesk.Revit.DB import *
clr.AddReference('RevitAPIUI')
clr.AddReference('System')
from System.Collections.Generic import List
clr.AddReference("RevitNodes")
import Revit
clr.ImportExtensions(Revit.Elements)
from Revit.Elements import *
clr.AddReference("RevitServices")
from Autodesk.Revit.UI import TaskDialog
import RevitServices
import Autodesk.Revit.DB.Element
from RevitServices.Persistence import DocumentManager
from RevitServices.Transactions import TransactionManager
from System import Enum
from Autodesk.Revit.Exceptions import *
import traceback
doc = DocumentManager.Instance.CurrentDBDocument

scope_box = FilteredElementCollector(doc).OfCategory(BuiltInCategory.OST_VolumeOfInterest).ToElements()
scope_box_names = []
scope_boxes = []
desired_scope_box_name = IN[2]
p_name = IN[1]
result = []

TransactionManager.Instance.EnsureInTransaction(doc)
try:
    for scope in scope_box:
        try:
            scope_box_names.append(scope.Name)
            scope_boxes.append(scope)
        except Exception as e:
            pass
    desired_name = None
    for box in scope_boxes:
    	desired_name = box.Name
        if desired_scope_box_name in desired_name :
            bounding_box = box.get_BoundingBox(None)
            bbox_min = bounding_box.Min
            bbox_max = bounding_box.Max
            outline = Outline(bbox_min, bbox_max)
            filter = BoundingBoxIntersectsFilter(outline)
            elements_within_scope_box = FilteredElementCollector(doc).WherePasses(filter).WhereElementIsNotElementType().ToElements()
            #element_ids = [element.Id for element in elements_within_scope_box]
            for element in elements_within_scope_box:
                #elements = doc.GetElement(e)
                if isinstance(element, View):
                    continue
                change = element.LookupParameter(p_name)
                if change != None and not change.IsReadOnly():
                    try:
                        change.Set(desired_name)
                        result.append("Success Adding Parameter Value: " + str(element.Id))
                    except:
                        result.append("Failed to set parameter for element with id: " + str(element.Id))
        else:
            continue
except:
    result.append(traceback.format_exc())
    for r in result:
        TaskDialog.Show("Error", r)
TransactionManager.Instance.TransactionTaskDone()
OUT = result
# ----------------------------------------
