# Dynamo graph MM - Python - Conduit Run_Copy Parameters from Element and paste into entire run.dyn (Dynamo 2.3.1.11775)

fence_over_conduits_conduit = Python()  # "Fence over Conduits/Conduit Fittings to copy parameter value from:"
# ---------- fence_over_conduits_conduit.python (161 lines) ----------
import clr
clr.AddReference("RevitAPIUI")
from Autodesk.Revit.UI import *
clr.AddReference("RevitAPI")
from Autodesk.Revit.DB import *
clr.AddReference("RevitServices")
import RevitServices
from RevitServices.Persistence import DocumentManager
from RevitServices.Transactions import TransactionManager
doc = DocumentManager.Instance.CurrentDBDocument
uidoc = DocumentManager.Instance.CurrentUIApplication.ActiveUIDocument
clr.AddReference("RevitNodes")
import Revit
clr.ImportExtensions(Revit.Elements)
clr.ImportExtensions(Revit.GeometryConversion)
from System.Collections.Generic import List
#Define Lists
pVStr = []
pVInt = []
pVEId = []
pVDouble = []
pVAVS = []
result = []

#Filtered Element Collectors
conduitFEC = FilteredElementCollector(doc).OfCategory(BuiltInCategory.OST_Conduit).WhereElementIsNotElementType().ToElements()
conduitFittingFEC = FilteredElementCollector(doc).OfCategory(BuiltInCategory.OST_ConduitFitting).WhereElementIsNotElementType().ToElements()	
#Define Selection Method
sel = uidoc.Selection
ot = Selection.ObjectType.Element
elemParamRef = sel.PickObjects(ot, "Select Elements to Copy Parameter Values From")
#For each selected element:
for ePR in elemParamRef:
	elemPR = doc.GetElement(ePR.ElementId)
	try:
		elemParamMap = elemPR.ParametersMap
		for ePS in elemParamMap:
			if not ePS.IsReadOnly:
				if ePS.HasValue == True:
					if ePS.CanBeAssociatedWithGlobalParameters() == True:
						if ePS.Definition.Visible == True:
							if ePS.StorageType == StorageType.String:
								if ePS.AsString() != None:
									if ePS.AsString() != "":
										elemParamValueAS = ePS.AsString()
										pVStr.Add([ePS.Definition.Name, elemParamValueAS])
										
							elif ePS.StorageType == StorageType.Integer:
								elemParamValueAI = ePS.AsInteger()
								pVInt.Add([ePS.Definition.Name, elemParamValueAI])
			     			
							elif ePS.StorageType == StorageType.ElementId:
								elemParamValueAEId = ePS.AsElementId()
								if str(elemParamValueAEId) != "-1":
									if ePS.Definition.Name != "Level":
										pVEId.Add([ePS.Definition.Name, elemParamValueAEId])
			          
							elif ePS.StorageType == StorageType.Double:
								elemParamValueAD = ePS.AsDouble()
								pVDouble.Add([ePS.Definition.Name, elemParamValueAD])
			                    
							else:
								elemParamValueAVS = ePS.AsValueString()
								pVAVS.Add([ePS.Definition.Name, elemParamValueAVS])
	except:
		result.Add("Get Parameter Values Failed")
	runId = []
	try:
		connectors = elemPR.MEPModel.ConnectorManager.Connectors
		for conn in connectors:
			for c in conn.AllRefs:
				conduitRunId = c.Owner.RunId 
	except:
		try:
			conduitRunId = elemPR.RunId
			
		except:
			result.Add("Get Connected Elements Failed")	
			continue
		
	test = []
	for cFEC in conduitFEC:
		try:
			if cFEC.RunId == conduitRunId:
				test.append(cFEC)
		except:
			result.Add("Get Conduits with Matching RunId Failed")	

	for cFFEC in conduitFittingFEC:
		try:	
			connectors1 = cFFEC.MEPModel.ConnectorManager.Connectors
			for conn in connectors1:
				for c in conn.AllRefs:
					conduitRunId1 = c.Owner.RunId 
					if conduitRunId1 == conduitRunId:
						test.append(cFFEC)
		except:
			result.Add("Get Conduit Fittings with Matching RunId Failed")

	for t in test:
		try:
			try:
				if pVStr != None:
					for pVS in pVStr:
						TransactionManager.Instance.EnsureInTransaction(doc)
						t.LookupParameter(pVS[0]).Set(pVS[1])
						TransactionManager.Instance.TransactionTaskDone()
						result.Add("String Parameter Success")
			except:
				result.Add("Set Parameter Failed")
			try:			
				if pVInt != None:
					for pVI in pVInt:
						TransactionManager.Instance.EnsureInTransaction(doc)
						t.LookupParameter(pVI[0]).Set(pVI[1])
						TransactionManager.Instance.TransactionTaskDone()
						result.Add("Integer Parameter Success")
			except:
				result.Add("Set Parameter Failed")
			try:			
				if pVDouble != None:
					for pVD in pVDouble:
						TransactionManager.Instance.EnsureInTransaction(doc)
						t.LookupParameter(pVD[0]).Set(pVD[1])
						TransactionManager.Instance.TransactionTaskDone()
						result.Add("Double Parameter Success")
			except:
				result.Add("Set Parameter Failed")
			try:	
				if pVEId != None:
					for pveid in pVEId:
						TransactionManager.Instance.EnsureInTransaction(doc)
						t.LookupParameter(pveid[0]).Set(pveid[1])
						TransactionManager.Instance.TransactionTaskDone()
						result.Add("ElementId Parameter Success")
			except:
				result.Add("Set Parameter Failed")			
			try:			
				if pVAVS != None:
					for pvavs in pVAVS:
						TransactionManager.Instance.EnsureInTransaction(doc)
						t.LookupParameter(pvavs[0]).Set(pvavs[1])
						TransactionManager.Instance.TransactionTaskDone()
						result.Add("Value String Parameter Success")
			except:
				result.Add("Set Parameter Failed")			
	
		except:
			result.Add("Set Parameter Failed")
		
		
		
			
		
	
	
try:
	OUT = result, test
except:
	OUT = result
	
# ----------------------------------------
watch = Watch(fence_over_conduits_conduit)  # graph output
