# Dynamo graph MM - Python - Copy Parameters from Element.dyn (Dynamo 2.3.1.11775)

click_element_to_copy_from_fence = Python()  # "Click Element to Copy From, Fence Over Elements to Paste to"; unwired: IN[0]
# ---------- click_element_to_copy_from_fence.python (124 lines) ----------
import clr
clr.AddReference("RevitAPIUI")
from Autodesk.Revit.UI import *
clr.AddReference("RevitAPI")
from Autodesk.Revit.DB import *
clr.AddReference("RevitServices")
import RevitServices
from RevitServices.Persistence import DocumentManager
from RevitServices.Transactions import TransactionManager
doc = DocumentManager.Instance.CurrentDBDocument
uidoc = DocumentManager.Instance.CurrentUIApplication.ActiveUIDocument

clr.AddReference("RevitNodes")
import Revit
clr.ImportExtensions(Revit.Elements)
clr.ImportExtensions(Revit.GeometryConversion)
from System.Collections.Generic import List


pVStr = []
pVInt = []
pVEId = []
pVDouble = []
pVAVS = []
result = []


sel = uidoc.Selection
ot = Selection.ObjectType.Element


elemParamRef = sel.PickObject(ot, "Select Element to Copy Parameter Values From")
elemPR = doc.GetElement(elemParamRef.ElementId)

try:
	elemParamMap = elemPR.ParametersMap
	for ePS in elemParamMap:
		if not ePS.IsReadOnly:
			if ePS.HasValue == True:
				if ePS.CanBeAssociatedWithGlobalParameters() == True:
					if ePS.Definition.Visible == True:
						if ePS.StorageType == StorageType.String:
							if ePS.AsString() != None:
								if ePS.AsString() != "":
									elemParamValueAS = ePS.AsString()
									pVStr.Add([ePS.Definition.Name, elemParamValueAS])
									
						elif ePS.StorageType == StorageType.Integer:
							elemParamValueAI = ePS.AsInteger()
							pVInt.Add([ePS.Definition.Name, elemParamValueAI])
		     			
						elif ePS.StorageType == StorageType.ElementId:
							elemParamValueAEId = ePS.AsElementId()
							if str(elemParamValueAEId) != "-1":
								if ePS.Definition.Name != "Level":
									pVEId.Add([ePS.Definition.Name, elemParamValueAEId])
		          
						elif ePS.StorageType == StorageType.Double:
							elemParamValueAD = ePS.AsDouble()
							pVDouble.Add([ePS.Definition.Name, elemParamValueAD])
		                    
						else:
							elemParamValueAVS = ePS.AsValueString()
							pVAVS.Add([ePS.Definition.Name, elemParamValueAVS])
except:
	result.Add("Get Parameter Values Failed")


elemsToPasteTo = sel.PickObjects(ot, "Select Element to Copy Parameter Values To")
try:
	for eTPT in elemsToPasteTo:
		elemsTPT = doc.GetElement(eTPT.ElementId)
		result.Add(elemsTPT)
		try:
			if pVStr != None:
				for pVS in pVStr:
					TransactionManager.Instance.EnsureInTransaction(doc)
					elemsTPT.LookupParameter(pVS[0]).Set(pVS[1])
					TransactionManager.Instance.TransactionTaskDone()
					result.Add("String Parameter Success")
		except:
			result.Add("Set Parameter Failed")
		try:			
			if pVInt != None:
				for pVI in pVInt:
					TransactionManager.Instance.EnsureInTransaction(doc)
					elemsTPT.LookupParameter(pVI[0]).Set(pVI[1])
					TransactionManager.Instance.TransactionTaskDone()
					result.Add("Integer Parameter Success")
		except:
			result.Add("Set Parameter Failed")
		try:			
			if pVDouble != None:
				for pVD in pVDouble:
					TransactionManager.Instance.EnsureInTransaction(doc)
					elemsTPT.LookupParameter(pVD[0]).Set(pVD[1])
					TransactionManager.Instance.TransactionTaskDone()
					result.Add("Double Parameter Success")
		except:
			result.Add("Set Parameter Failed")
		try:	
			if pVEId != None:
				for pveid in pVEId:
					TransactionManager.Instance.EnsureInTransaction(doc)
					elemsTPT.LookupParameter(pveid[0]).Set(pveid[1])
					TransactionManager.Instance.TransactionTaskDone()
					result.Add("ElementId Parameter Success")
		except:
			result.Add("Set Parameter Failed")			
		try:			
			if pVAVS != None:
				for pvavs in pVAVS:
					TransactionManager.Instance.EnsureInTransaction(doc)
					elemsTPT.LookupParameter(pvavs[0]).Set(pvavs[1])
					TransactionManager.Instance.TransactionTaskDone()
					result.Add("Value String Parameter Success")
		except:
			result.Add("Set Parameter Failed")
except:
	result.Add("Set Parameter Failed")

	

OUT = result
# ----------------------------------------
