# Dynamo graph MM - Python - Create Starting View.dyn (Dynamo 2.0.4.12684)

view_name = StringInput("MM - GF - Working View")  # graph input
sub_discipline = StringInput("MM - Working Views")  # graph input
levels = Levels(index=0)  # graph input
view_type_use_exact_name_listed = StringInput("Floor Plan")  # "View Type(Use exact name listed): Floor Plan, Ceiling Plan, Electrical Section, Detail, 3D View"; graph input
area = StringInput("A")  # graph input
trade_code = StringInput("ELE")  # graph input
scope_box = BoolSelector(false)  # graph input
if_true_scope_box_name = StringInput("Test")  # graph input
detail_level_coarse_medium_fine = StringInput("Coarse")  # graph input
view_template = BoolSelector(false)  # graph input
if_true_view_template_name = StringInput("Test")  # graph input
adjust_view_range = BoolSelector(false)  # graph input
if_true_top_offset_in_feet = DoubleSlider(30, range=0..100 step 0.1)  # graph input
if_true_bottom_offset_in_feet = DoubleSlider(0, range=0..100 step 0.1)  # graph input
if_true_cut_plane_in_feet = DoubleSlider(10, range=0..100 step 0.1)  # graph input
python_create_view_set_name_and = Python(IN[0]=view_name, IN[1]=sub_discipline, IN[2]=levels, IN[3]=view_type_use_exact_name_listed, IN[4]=area, IN[5]=trade_code, IN[6]=scope_box, IN[7]=if_true_scope_box_name, IN[8]=detail_level_coarse_medium_fine, IN[9]=view_template, IN[10]=if_true_view_template_name, IN[11]=adjust_view_range, IN[12]=if_true_top_offset_in_feet, IN[13]=if_true_bottom_offset_in_feet, IN[14]=if_true_cut_plane_in_feet)  # "Python Create View, Set Name and Set Sorting Parameter Values"
# ---------- python_create_view_set_name_and.python (157 lines) ----------
import clr
import sys
pyPath = r"C:\Program Files (x86)\IronPython 2.7\Lib"
sys.path.append(pyPath)

clr.AddReference('RevitAPI')
from Autodesk.Revit.DB import *
from Autodesk.Revit.DB.Structure import *

clr.AddReference('RevitAPIUI')
from Autodesk.Revit.UI import *

clr.AddReference('System')
from System.Collections.Generic import List

clr.AddReference('RevitNodes')
import Revit
clr.ImportExtensions(Revit.GeometryConversion)
clr.ImportExtensions(Revit.Elements)

clr.AddReference('RevitServices')
import RevitServices
from RevitServices.Persistence import DocumentManager
from RevitServices.Transactions import TransactionManager



doc = DocumentManager.Instance.CurrentDBDocument
uidoc = DocumentManager.Instance.CurrentUIApplication.ActiveUIDocument
#uiapp = DocumentManager.Instance.CurrentUIApplication


#Inputs
vName = IN[0]
vSD = IN[1]
lvl = IN[2]
viewTypeName = IN[3]
vArea = IN[4]
vTC = IN[5]
scopeBoo = IN[6]
scopeName = IN[7]
detailLevel = IN[8]
vTBoo = IN[9]
vTN = IN[10]
tof = IN[12]
bof = IN[13]
cof = IN[14]
vRBoo = IN[11]


result = []
#Find ViewType by name to get elementID
viewFamilyTypes = FilteredElementCollector(doc).OfClass(ViewFamilyType).ToElements()
for viewType in viewFamilyTypes:
	typeName = viewType.get_Parameter(BuiltInParameter.SYMBOL_NAME_PARAM).AsString()
	if typeName == viewTypeName:
		viewFamilyTypeId = viewType.Id

def setParamVal(element, parameter, value):
	element.LookupParameter(parameter).Set(value)

def modViewrange(vp,tof,bof,cof):
	#v = UnwrapElement(vp)
	#getting the viewrange of the view
	viewrange = vp.GetViewRange()
	asslvl = vp.GenLevel
	#Setting top clip plane of the viewrange
	#	Setting level of topclip plane
	viewrange.SetLevelId(PlanViewPlane.TopClipPlane,asslvl.Id)
	#	setting offset of top clip plane
	viewrange.SetOffset(PlanViewPlane.TopClipPlane,tof)
	#Setting bottom clip plane of the viewrange
	#	Setting level of bottom clip plane
	viewrange.SetLevelId(PlanViewPlane.BottomClipPlane,asslvl.Id)
	#	setting offset of bottom clip plane
	viewrange.SetOffset(PlanViewPlane.BottomClipPlane,bof)
	viewrange.SetOffset(PlanViewPlane.CutPlane,cof)
	#Setting view depth plane of the viewrange
	#	Setting level of view depth plane
	viewrange.SetLevelId(PlanViewPlane.ViewDepthPlane,asslvl.Id)
	#	setting offset of view depth plane
	if bof < 0 or cof:
		viewrange.SetOffset(PlanViewPlane.ViewDepthPlane,bof)
	else:
		viewrange.SetOffset(PlanViewPlane.ViewDepthPlane,0)
	#Applying the viewrange to the view
	vp.SetViewRange(viewrange)





#Create View
TransactionManager.Instance.EnsureInTransaction(doc)
createView = ViewPlan.Create(doc, viewFamilyTypeId , ElementId(lvl.Id))
TransactionManager.Instance.TransactionTaskDone()

try:
	TransactionManager.Instance.EnsureInTransaction(doc)
	renameView = setParamVal(createView,"View Name", vName)
	removeVT = setParamVal(createView,"View Template", ElementId(-1))
	setSD = setParamVal(createView,"Sub-Discipline", vSD)
	setLvl = setParamVal(createView,"Level", lvl.Name)
	setArea = setParamVal(createView,"Area", vArea)
	setTC = setParamVal(createView,"Trade Code", vTC)
	setDL = setParamVal(createView,"Detail Level", detailLevel)
	
	
	if scopeBoo == True:
		try:
			scopeBoxes = FilteredElementCollector(doc).OfCategory(BuiltInCategory.OST_VolumeOfInterest).ToElements()
			for sBN in scopeBoxes:
				sBName = sBN.Name
				if sBName == scopeName:
					sBId = sBN.Id
			setScope = setParamVal(createView,"Scope Box", sBId)
		except:
			result.append("No Scope Box by that name existed")

	if vTBoo == True:
		try:
			viewTemplate = FilteredElementCollector(doc).OfCategory(BuiltInCategory.OST_Views).ToElements()
			
			for vT in viewTemplate:
				if vT.IsTemplate == True:
					vTName = vT.Name
					if vTName == vTN:
						vTId = vT.Id
			setvT = setParamVal(createView,"View Template", vTId)
		except:
			result.append("No View Template by that name existed")
	


	TransactionManager.Instance.TransactionTaskDone()
except:
	result.append("Parameter Name not Found")

if vRBoo == True:	
	try:	
		TransactionManager.Instance.EnsureInTransaction(doc)
		modViewrange(createView,tof,bof,cof)
		TransactionManager.Instance.TransactionTaskDone()	
	except:
		import traceback
		message = traceback.format_exc() 
		result.append(message)




TransactionManager.Instance.ForceCloseTransaction()
uidoc.RequestViewChange(createView)

result.append("All Parameters Set Successfully")

OUT = createView, result
# ----------------------------------------
