# Dynamo graph MM - Python - Edit Schedule Filters.dyn (Dynamo 2.0.4.12684)

containString = StringInput("22")
replaceString = StringInput("88")
for_all_schedules_find_schedule = Python(IN[0]=containString, IN[1]=replaceString)  # "For All Schedules, find Schedule Filter Value that containString, and replaceString"
# ---------- for_all_schedules_find_schedule.python (83 lines) ----------
import clr
import System

clr.AddReference("RevitServices")
import RevitServices
from RevitServices.Persistence import DocumentManager
from RevitServices.Transactions import TransactionManager

doc = DocumentManager.Instance.CurrentDBDocument

clr.AddReference("RevitAPI")
import Autodesk
from Autodesk.Revit.DB import *

clr.AddReference("RevitNodes")
import Revit
clr.ImportExtensions(Revit.Elements)

from System.Collections.Generic import List
import re

containString = str(IN[0])
replaceString = str(IN[1])

scheduleElem = FilteredElementCollector(doc).OfCategory(BuiltInCategory.OST_Schedules).WhereElementIsNotElementType().ToElements()

for sE in scheduleElem:
	
	try:
		sFD = sE.Definition
		sF = sE.Definition.GetFilters()
		if sF != None:
			i = 0
			for sf in sF:
				sFId = sf.FieldId
				sFT = sf.FilterType
				if sf.IsStringValue: 
					sFVs = sf.GetStringValue()
				if re.search(containString, sFVs):
					sFReplaced = sFVs.replace(containString, replaceString)
					
					TransactionManager.Instance.EnsureInTransaction(doc)
					sf.SetValue(sFReplaced)
					sFD.SetFilter(int(i), sf)
					TransactionManager.Instance.TransactionTaskDone()
						
				if sf.IsDoubleValue:
					sFVd = sf.GetDoubleValue().ToString()
					if re.search(containString, sFVd):
						sFReplaced = sFVd.replace(containString, replaceString)
						
						TransactionManager.Instance.EnsureInTransaction(doc)
						sf.SetValue(float(sFReplaced))
						sFD.SetFilter(int(i), sf)
						TransactionManager.Instance.TransactionTaskDone()
						
				if sf.IsIntegerValue:
					sFVi = sf.GetIntegerValue().ToString()
					if re.search(containString, sFVi):
						sFReplaced = sFVi.replace(containString, replaceString)
						
						TransactionManager.Instance.EnsureInTransaction(doc)
						sf.SetValue(int(sFReplaced))
						sFD.SetFilter(int(i), sf)
						TransactionManager.Instance.TransactionTaskDone()
						
				if sf.IsElementIdValue:
					sFVId = sf.GetElementIdValue().ToString()
					
					if re.search(containString, sFVId):
						sFReplaced = sFVId.replace(containString, replaceString)
						
						TransactionManager.Instance.EnsureInTransaction(doc)
						sf.SetValue(int(sFReplaced))						
						sFD.SetFilter(int(i), sf)
						TransactionManager.Instance.TransactionTaskDone()
						
				i += 1		
	except Exception:
		OUT = "You are the Weakest Coder, Good Bye"

		
OUT = "Success!"
# ----------------------------------------
