# Dynamo graph MM - Python - Entire Project Get Parameter A Value, Set to Parameter B.dyn (Dynamo 2.3.2.15696)

parametername_a = StringInput("HEC_Subcategory (Secondary)")
parametername_b = StringInput("HEC_Subcategory")
get_project_parameter_value_set = Python(IN[0]=parametername_a, IN[1]=parametername_b)  # "Get Project Parameter value, set to new Project Parameter"
# ---------- get_project_parameter_value_set.python (39 lines) ----------
import clr
clr.AddReference("RevitAPI")
from Autodesk.Revit.DB import *
clr.AddReference("RevitServices")
import RevitServices
from RevitServices.Persistence import DocumentManager
from RevitServices.Transactions import TransactionManager
doc = DocumentManager.Instance.CurrentDBDocument
from System.Collections.Generic import List
#Define Lists
parameterA = IN[0]
parameterB = IN[1]
FECActiveView = FilteredElementCollector(doc).WhereElementIsNotElementType().OfCategory(BuiltInCategory.OST_Views).FirstElement()
ParameterID = FECActiveView.LookupParameter(parameterA).Id

ElementParameterHasValueFilter = ParameterFilterRuleFactory.CreateHasValueParameterRule(ParameterID)

#Filtered Element Collectors
FEC = FilteredElementCollector(doc).WhereElementIsNotElementType().WherePasses(ElementParameterFilter(ElementParameterHasValueFilter)).ToElements()

parameterAVal = None
for element in FEC:
	if element.LookupParameter(parameterA).HasValue and element.LookupParameter(parameterA).AsString() != "":
		parameterAVal = element.LookupParameter(parameterA).AsString()
		TransactionManager.Instance.EnsureInTransaction(doc)
		element.LookupParameter(parameterB).Set(parameterAVal)
		TransactionManager.Instance.TransactionTaskDone()





			
		
	
	

OUT = parameterAVal, parameterA, parameterB
	
# ----------------------------------------
