# Dynamo graph MM - Python - Export View to Navisworks.dyn (Dynamo 2.3.1.11775)

name_of_3d_views_to_be_exported = StringInput("3D Ortho, {3D}, Another 3D")  # "Name of 3D Views to be Exported to Navis, with a delimiter such as ", " between them"; graph input
delimeter_include_space_if_there = StringInput(", ")  # graph input
directory_path = Directory("C:\Users\MMeyers\Downloads")  # graph input
export_view_multiple_views = Python(IN[0]=name_of_3d_views_to_be_exported, IN[1]=delimeter_include_space_if_there, IN[2]=directory_path)
# ---------- export_view_multiple_views.python (48 lines) ----------
import clr
import sys
sys.path.append('C:\Program Files (x86)\IronPython 2.7\Lib')
import System
from System import Array
from System.Collections.Generic import *
clr.AddReference('ProtoGeometry')
from Autodesk.DesignScript.Geometry import *
clr.AddReference("RevitNodes")
import Revit
clr.ImportExtensions(Revit.Elements)
clr.ImportExtensions(Revit.GeometryConversion)
clr.AddReference("RevitServices")
import RevitServices
from RevitServices.Persistence import DocumentManager 
from RevitServices.Transactions import TransactionManager 
clr.AddReference("RevitAPI")
clr.AddReference("RevitAPIUI")
import Autodesk 
from Autodesk.Revit.DB import *
import traceback

doc = DocumentManager.Instance.CurrentDBDocument

result = []

viewNames = IN[0]
delimiter = IN[1]
exportFolderPath = IN[2]
t = []
vNSplit = viewNames.split(delimiter)
v3DFEC = FilteredElementCollector(doc).OfClass(View3D).ToElements()
for vNS, v3D in zip(vNSplit, v3DFEC):
	if v3D.Name.ToString() == vNS:
		t.append(v3D)
		opt = NavisworksExportOptions()
		opt.ExportScope = NavisworksExportScope.View;
		opt.ViewId = v3D.Id;

		doc.Export(exportFolderPath, v3D.Name.ToString() + ".nwc", opt)
		


try:
	OUT =  result, t
	
except:
	OUT = result
# ----------------------------------------
