# Dynamo graph MM - Python - Family - APL - Add Shared Parameters.dyn (Dynamo 2.12.1.8246)

# group: Type Parameters and User Inputs
type_parameter_name_s = StringInput("APL_PointPrefix, ")  # graph input
instance_parameter_name_s = StringInput("HEC_RTS_Visibile, ")  # graph input
delimeter_include_space_if = StringInput(", ")  # "Delimeter(include space if exists)"
rts_description_for_formula = StringInput("Description")  # "RTS Description for Formula Field. for non Parameter Names add \" before and after ex. \" Description Desired "\ Parameter Name ex. HEC_Description"; graph input
rts_prefix_to_formula = StringInput("LF")  # graph input

add_shared_parameter_to_family = Python(IN[0]=type_parameter_name_s, IN[1]=instance_parameter_name_s, IN[2]=delimeter_include_space_if, IN[3]=rts_description_for_formula, IN[4]=rts_prefix_to_formula)  # IronPython2
# ---------- add_shared_parameter_to_family.python (116 lines) ----------
import clr
clr.AddReference('RevitAPI')
from Autodesk.Revit.DB import*

clr.AddReference('RevitServices')
from RevitServices.Persistence import DocumentManager
from RevitServices.Transactions import TransactionManager

doc = DocumentManager.Instance.CurrentDBDocument
uiapp = DocumentManager.Instance.CurrentUIApplication
app = uiapp.Application

#Inputs
TypeParameterNames = IN[0] 
InstanceParameterNames = IN[1]
delim = IN[2]
Description = IN[3]
Prefix = IN[4]

#Lists
result = []
	
def DefinitionFileByParameterName(ParameterName):
	SharedParameterFile = app.OpenSharedParameterFile()
	Groups = SharedParameterFile.Groups
	for Group in Groups:
		GroupDefinition = Group.Definitions
		for GroupDef in GroupDefinition:
			if GroupDef.Name == ParameterName:
				return GroupDef
	
	
def GetBuiltInParameterGroup(ParameterName):
	SharedParameterFile = app.OpenSharedParameterFile()
	Groups = SharedParameterFile.Groups
	for Group in Groups:
		GroupDefinition = Group.Definitions
		for GroupDef in GroupDefinition:
			if GroupDef.Name == ParameterName:
				if GroupDef.Name == "HEC_Host Element" or GroupDef.Name == "HEC_Nested Element" or GroupDef.Name == "HEC_Remarcable ID" or GroupDef.Name == "HEC_Description":
					BIPGroup = BuiltInParameterGroup.PG_IDENTITY_DATA
				elif GroupDef.ParameterType.ToString() == "Length" or GroupDef.ParameterType.ToString() == "Angle" or GroupDef.ParameterType.ToString() == "ElectricalConduitSize":
					BIPGroup = BuiltInParameterGroup.PG_GEOMETRY
				elif GroupDef.OwnerGroup.Name == "RTS":
					BIPGroup = BuiltInParameterGroup.PG_DATA
				elif GroupDef.ParameterType.ToString() == "Text":
					BIPGroup = BuiltInParameterGroup.PG_TEXT
				elif GroupDef.ParameterType.ToString() == "YesNo":
					BIPGroup = BuiltInParameterGroup.PG_VISIBILITY
				elif GroupDef.ParameterType.ToString() == "Integer":
					BIPGroup = BuiltInParameterGroup.PG_CONSTRUCTION
				else:
					BIPGroup = BuiltInParameterGroup.PG_GENERAL
			
				return BIPGroup
	
#Type Parameters
if TypeParameterNames != "" or TypeParameterNames != none:
	TypeParameterName = TypeParameterNames.split(delim)
	for TypeParamName in TypeParameterName:
		try:
			TransactionManager.Instance.EnsureInTransaction(doc)
			TypeDefinitionFileParameter = DefinitionFileByParameterName(TypeParamName)
			TypeDefinitionFileGroup = GetBuiltInParameterGroup(TypeParamName)
			doc.FamilyManager.AddParameter(TypeDefinitionFileParameter, TypeDefinitionFileGroup, False)
			TransactionManager.Instance.ForceCloseTransaction()
		except Exception as e:
			result.append([e,"Type Parameter Failed"])
			TransactionManager.Instance.ForceCloseTransaction()
		
if InstanceParameterNames != "" or InstanceParameterNames != none:
	InstanceParameterName = InstanceParameterNames.split(delim)	
	for InstanceParamName in InstanceParameterName:
		try :
			TransactionManager.Instance.EnsureInTransaction(doc)
			InstanceDefinitionFileParameter = DefinitionFileByParameterName(InstanceParamName)
			InstanceDefinitionFileGroup = GetBuiltInParameterGroup(InstanceParamName)
			doc.FamilyManager.AddParameter(InstanceDefinitionFileParameter, InstanceDefinitionFileGroup, True)
			TransactionManager.Instance.ForceCloseTransaction()
		except Exception as e:
			result.append([ e, "Instance Parameter Failed"])
			TransactionManager.Instance.ForceCloseTransaction()

			
famParamList = doc.FamilyManager.GetParameters()
TransactionManager.Instance.EnsureInTransaction(doc)
try:
	for FamilyParameter in famParamList:
		if "PointRole" in FamilyParameter.Definition.Name:
			doc.FamilyManager.SetFormula(FamilyParameter, "\"Stake Out\"")
		if "PointDescription" in FamilyParameter.Definition.Name or "HEC_Description" in FamilyParameter.Definition.Name:
			doc.FamilyManager.SetFormula(FamilyParameter, Description)
		if "PointPrefix" in FamilyParameter.Definition.Name:
			doc.FamilyManager.SetFormula(FamilyParameter, "\"" + Prefix + "\"")
		if "PointElement" in FamilyParameter.Definition.Name:
			doc.FamilyManager.SetFormula(FamilyParameter, "\"" + doc.Title.ToString() + "\"")

except Exception as e:
		result.append([e, "Add Point Formulas Failed"])
		
TransactionManager.Instance.ForceCloseTransaction()
		
#FilteredElementCollectorGeneric = FilteredElementCollector(doc, doc.ActiveView.Id).OfCategory(BuiltInCategory.OST_GenericModel).WhereElementIsNotElementType().ToElements()
#for FECElement in FilteredElementCollectorGeneric:
#	FECElementName = FECElement.Symbol.FamilyName.ToString()
#	if FECElementName.__contains__("GTP"):
#		ElementParamList = FECElement.GetParameters()
#		for ElementParam in ElementParameList:
#			ElementParamName = Element.Name
#			if ElementParamName.__contains__("PointDescription"):			
#				TransactionManager.Instance.EnsureInTransaction(doc)
#				FECElement.LookupParameter(ElementParamName).Set(FECElementName)
#				TransactionManager.Instance.ForceCloseTransaction()
	
		
OUT =  result
# ----------------------------------------
