# Dynamo graph MM - Python - Family - Add Shared Parameters.dyn (Dynamo 2.12.1.8246)

type_parameter_name_s = StringInput("")  # graph input
instance_parameter_name_s = StringInput("HEC_Description, HEC_WBS ID, HEC_Remarcable ID, ")  # graph input
delimeter_include_space_if = StringInput(", ")  # "Delimeter(include space if exists)"; graph input
add_shared_parameter_to_family = Python(IN[0]=type_parameter_name_s, IN[1]=instance_parameter_name_s, IN[2]=delimeter_include_space_if)  # IronPython2
# ---------- add_shared_parameter_to_family.python (115 lines) ----------
import clr
clr.AddReference('RevitAPI')
from Autodesk.Revit.DB import FamilyManager, BuiltInParameterGroup

clr.AddReference('RevitServices')
from RevitServices.Persistence import DocumentManager
from RevitServices.Transactions import TransactionManager

doc = DocumentManager.Instance.CurrentDBDocument
uiapp = DocumentManager.Instance.CurrentUIApplication
app = uiapp.Application

#Inputs

TypeParameterNames = IN[0] 
InstanceParameterNames = IN[1]
delim = IN[2]

#Lists
result = []

#ExternalDefinition

	
def DefinitionFileByParameterName(ParameterName):
	SharedParameterFile = app.OpenSharedParameterFile()
	Groups = SharedParameterFile.Groups
	for Group in Groups:
		GroupDefinition = Group.Definitions
		for GroupDef in GroupDefinition:
			if GroupDef.Name == ParameterName:
				return GroupDef
	
	
def GetBuiltInParameterGroup(ParameterName):
	SharedParameterFile = app.OpenSharedParameterFile()
	Groups = SharedParameterFile.Groups
	for Group in Groups:
		GroupDefinition = Group.Definitions
		for GroupDef in GroupDefinition:
			if GroupDef.Name == ParameterName:
				if GroupDef.Name == "HEC_Host Element" or GroupDef.Name == "HEC_Nested Element" or GroupDef.Name == "HEC_Remarcable ID" or GroupDef.Name == "HEC_Description":
					BIPGroup = BuiltInParameterGroup.PG_IDENTITY_DATA
				elif GroupDef.ParameterType.ToString() == "Length" or GroupDef.ParameterType.ToString() == "Angle" or GroupDef.ParameterType.ToString() == "ElectricalConduitSize":
					BIPGroup = BuiltInParameterGroup.PG_GEOMETRY
				elif GroupDef.OwnerGroup.Name == "RTS":
					BIPGroup = BuiltInParameterGroup.PG_DATA
				elif GroupDef.ParameterType.ToString() == "Text":
					BIPGroup = BuiltInParameterGroup.PG_TEXT
				elif GroupDef.ParameterType.ToString() == "YesNo":
					BIPGroup = BuiltInParameterGroup.PG_VISIBILITY
				elif GroupDef.ParameterType.ToString() == "Integer":
					BIPGroup = BuiltInParameterGroup.PG_CONSTRUCTION
				else:
					BIPGroup = BuiltInParameterGroup.PG_GENERAL
			
				return BIPGroup
	
#Type Parameters
if TypeParameterNames != "":
	TypeParameterName = TypeParameterNames.split(delim)
	for TypeParamName in TypeParameterName:

		try:
			TransactionManager.Instance.EnsureInTransaction(doc)
			TypeDefinitionFileParameter = DefinitionFileByParameterName(TypeParamName)
			TypeDefinitionFileGroup = GetBuiltInParameterGroup(TypeParamName)
			TypeParamName = doc.FamilyManager.AddParameter(TypeDefinitionFileParameter, TypeDefinitionFileGroup, False)
			result.append('Added Type Parameter Successfully')
			TransactionManager.Instance.ForceCloseTransaction()
			#Set Formula for Host/Nested
			if doc.Title.ToString().lower().__contains__("nested"):
				if TypeParamName.Definition.Name == "HEC_Host Element":
					TransactionManager.Instance.EnsureInTransaction(doc)
					doc.FamilyManager.SetFormula(TypeParamName, str("1=0"))
					TransactionManager.Instance.TransactionTaskDone()
					result.append("Host formula equals False")
				elif TypeParamName.Definition.Name == "HEC_Nested Element":
					TransactionManager.Instance.EnsureInTransaction(doc)
					doc.FamilyManager.SetFormula(TypeParamName, str("1=1"))
					TransactionManager.Instance.TransactionTaskDone()
					result.append("Nested formula equals True")
			else:
				if TypeParamName.Definition.Name == "HEC_Host Element":
					TransactionManager.Instance.EnsureInTransaction(doc)
					doc.FamilyManager.SetFormula(TypeParamName, str("1=1"))
					TransactionManager.Instance.TransactionTaskDone()
					result.append("Host formula equals True")
	
				elif TypeParamName.Definition.Name == "HEC_Nested Element":
					TransactionManager.Instance.EnsureInTransaction(doc)
					doc.FamilyManager.SetFormula(TypeParamName, str("1=0"))
					TransactionManager.Instance.TransactionTaskDone()
					result.append("Nested formula equals False")
			
		except Exception as e:
			result.append(e)
			TransactionManager.Instance.ForceCloseTransaction()
#Instance Parameters
if InstanceParameterNames != "":
	InstanceParameterName = InstanceParameterNames.split(delim)	
	for InstanceParamName in InstanceParameterName:

		try :
			TransactionManager.Instance.EnsureInTransaction(doc)
			InstanceDefinitionFileParameter = DefinitionFileByParameterName(InstanceParamName)
			InstanceDefinitionFileGroup = GetBuiltInParameterGroup(InstanceParamName)
			doc.FamilyManager.AddParameter(InstanceDefinitionFileParameter, InstanceDefinitionFileGroup, True)
			result.append('Added Instance Parameter Successfully')
			TransactionManager.Instance.ForceCloseTransaction()
		except Exception as e:
			result.append(e)
			TransactionManager.Instance.ForceCloseTransaction()

OUT = result
# ----------------------------------------
