# Dynamo graph MM - Python - Family - Multiple Families Swap Family Parameters to Shared Parameters.dyn (Dynamo 2.3.2.15696)

refresh = BoolSelector(true)
copy_paste_family_directory = StringInput("C:\\Users\\MMeyers\\Downloads")  # "Copy/Paste Family Directory, Needs \\ not \ in the path"; graph input
add_parameters_to_file_folder = Python(IN[0]=refresh, IN[1]=copy_paste_family_directory)  # "Add Parameters to File Folder full of families"
# ---------- add_parameters_to_file_folder.python (90 lines) ----------
import clr
import os
import sys
import System
clr.AddReference('ProtoGeometry')
from Autodesk.DesignScript.Geometry import *
import Autodesk.DesignScript.Geometry as DS

clr.AddReference('RevitAPI')
import Autodesk
from Autodesk.Revit.DB import *
import Autodesk.Revit.DB as DB

clr.AddReference('RevitServices')
import RevitServices
from RevitServices.Persistence import DocumentManager
from RevitServices.Transactions import TransactionManager

doc = DocumentManager.Instance.CurrentDBDocument
uiapp = DocumentManager.Instance.CurrentUIApplication
app = uiapp.Application


pf_path = System.Environment.GetFolderPath(System.Environment.SpecialFolder.ProgramFilesX86)
sys.path.append(pf_path + '\\IronPython 2.7\\Lib')

fampaths = IN[1]


#Get Active Documents Shared Param File
def defFile(shareFile, group, param) :
	shareFile = app.OpenSharedParameterFile()
	defGroup = shareFile.Groups.get_Item(group)
	return defGroup.Definitions.get_Item(param)
	
#Start Functions	

endsWith = str(".rfa")

i = 0
result = []
try:
	for file in os.listdir(fampaths):
		if file.endswith(endsWith):
			doc = DocumentManager.Instance.CurrentDBDocument
			TransactionManager.Instance.ForceCloseTransaction()
			famdoc = app.OpenDocumentFile(fampaths + "\\" + file)
			try :
				allParams = famdoc.FamilyManager.GetParameters()
				for aP in (aP for aP in allParams if aP.Definition.Name.lower() == "height"): 
					boo = aP.IsInstance
					eDef = defFile(file, "Dimensions", "HEC_Height")
					TransactionManager.Instance.EnsureInTransaction(famdoc)
					famdoc.FamilyManager.ReplaceParameter(aP, eDef, BuiltInParameterGroup.PG_GEOMETRY, boo)
					TransactionManager.Instance.ForceCloseTransaction()
				for aP in (aP for aP in allParams if aP.Definition.Name.lower() == "length"): 
					boo = aP.IsInstance
					eDef = defFile(file, "Dimensions", "HEC_Length")
					TransactionManager.Instance.EnsureInTransaction(famdoc)
					famdoc.FamilyManager.ReplaceParameter(aP, eDef, BuiltInParameterGroup.PG_GEOMETRY, boo )
					TransactionManager.Instance.ForceCloseTransaction()
				for aP in (aP for aP in allParams if aP.Definition.Name.lower() == "width"): 
					boo = aP.IsInstance
					eDef = defFile(file, "Dimensions", "HEC_Width")
					TransactionManager.Instance.EnsureInTransaction(famdoc)
					famdoc.FamilyManager.ReplaceParameter(aP, eDef, BuiltInParameterGroup.PG_GEOMETRY, boo )
					TransactionManager.Instance.ForceCloseTransaction()
				for aP in (aP for aP in allParams if aP.Definition.Name.lower() == "depth"): 
					boo = aP.IsInstance
					eDef = defFile(file, "Dimensions", "HEC_Depth")
					TransactionManager.Instance.EnsureInTransaction(famdoc)
					famdoc.FamilyManager.ReplaceParameter(aP, eDef, BuiltInParameterGroup.PG_GEOMETRY, boo)
					TransactionManager.Instance.ForceCloseTransaction()

			except :
				result.append("Error Replacing Parameters")
				TransactionManager.Instance.ForceCloseTransaction()
			      
	
			i += 1
			famdoc.Close(True)
			famdoc.Dispose()	
	            
except:

	result.append("Failed")
	TransactionManager.Instance.ForceCloseTransaction()
	
			
OUT = result
# ----------------------------------------
