# Dynamo graph MM - Python - Family Swap - Coding Manipulation Required.dyn (Dynamo 2.6.2.15705)

family_types_to_change = FamilyTypes()  # nothing selected; graph input
family_types_to_change_to = FamilyTypes("HEC_Wall_Pen:WALL_PEN_STANDARD")  # graph input
ignorecase = BoolSelector(false)
python = Python(IN[0]=family_types_to_change, IN[1]=family_types_to_change_to, IN[2]=ignorecase)
# ---------- python.python (257 lines) ----------
import clr
import sys

pyPath = r"C:\Program Files (x86)\IronPython 2.7\Lib"
sys.path.append(pyPath)

import System 
import System.Collections
#Access to Revit Document
clr.AddReference("RevitServices")
import RevitServices
#To Get Doc, UI and Application Objects
from RevitServices.Persistence import DocumentManager
#Needed to make any changes in Revit
from RevitServices.Transactions import TransactionManager
clr.AddReference("RevitNodes")
import Revit
clr.ImportExtensions(Revit.Elements)
clr.ImportExtensions(Revit.GeometryConversion)
clr.AddReference("RevitAPI")
from Autodesk.Revit.DB import *

from Autodesk.Revit.DB.Structure import *
clr.AddReference("RevitAPIUI")
from Autodesk.Revit.UI import *
from System.Collections.Generic import List
import traceback

doc = DocumentManager.Instance.CurrentDBDocument
uidoc = DocumentManager.Instance.CurrentUIDocument
app = DocumentManager.Instance.CurrentUIApplication.Application

def getParameterVal(element, parameterName):
	return element.LookupParameter(parameterName).AsValueString()
def getParameterValAsString(element, parameterName):
	return element.LookupParameter(parameterName).AsString()
	
def getParameterValDouble(element, parameterName):
	return element.LookupParameter(parameterName).AsDouble()

def setParamByName(element, parameterName, value):
	element.LookupParameter(parameterName).Set(value)
	return value
	
def getBIPParamVal(element, BIParameter):
	return element.get_Parameter(BIParameter).AsValueString()
	
def getBIPParamValAsString(element, BIParameter):
	return element.get_Parameter(BIParameter).AsString()

def getBIPParamValDouble(element, BIParameter):
	return element.get_Parameter(BIParameter).AsDouble()

def setBIPParamVal(element, BIParameter, value):
	element.get_Parameter(BIParameter).Set(value)
	return value

#Define Lists
elemTypeName = []

# The inputs to this node will be stored as a list in the IN variables.
dataEnteringNode = IN
famTypeToChange = IN[0]
famTypeToChangeTo = IN[1]

#valOneParam = "Angle"
#valTwoParam = "HEC_Angle"
#valOne = getParameterValDouble(UnwrapElement(famTypeToChange), valOneParam)
#valTwo = getParameterValDouble(UnwrapElement(famTypeToChangeTo), valTwoParam)

famTypeToChangeName = famTypeToChange.Name.ToString()
famTypeToChangeFamName = UnwrapElement(famTypeToChange).FamilyName.ToString()
famTypeToChangeToName = famTypeToChangeTo.Name.ToString()
famTypeToChangeToFamName = UnwrapElement(famTypeToChange).FamilyName.ToString()


#No User Changes Needed till Line 207
TransactionManager.Instance.EnsureInTransaction(doc)
#Get Elements with Family Name Matching info Above
string = famTypeToChangeFamName
case = IN[2]
search = "Family"
bips = System.Enum.GetValues(BuiltInParameter)
bm = doc.ParameterBindings
bmlist = bm.ForwardIterator()
paramId = None
testout = []
while bmlist.MoveNext():
	binddef = bmlist.Key
	testout.append(binddef.Name)
	if binddef.Name == search:
		paramId = binddef.Id
		break
param = None
if paramId == None:
	biplist = []
	for bip in bips:
		try:
			name = LabelUtils.GetLabelFor(bip)
		except:
			continue
		if name == search:
			biplist.append(bip)
sharedparamrule = SharedParameterApplicableRule(search)
evaluator = FilterStringContains()
parameter = None
if paramId == None and len(biplist) == 0:
	coll = FilteredElementCollector(doc)
	sharedparams = coll.OfClass(ParameterElement)
	for param in sharedparams:
		name = param.GetDefinition().Name
		if name == search:
			parameter = param
	if parameter != None:
		ruleslist = List[FilterRule]()
		provider = ParameterValueProvider(parameter.Id)
		filterrule = FilterStringRule(provider, evaluator, string , case)
		ruleslist.Add(filterrule)
		ruleslist.Add(sharedparamrule)
		paramFilter = ElementParameterFilter(ruleslist)
		collector = FilteredElementCollector(doc, doc.ActiveView.Id)
		collector.OfClass(FamilyInstance).WherePasses(paramFilter)
		collector2 = FilteredElementCollector(doc, doc.ActiveView.Id)
		collector2.OfClass(HostObject).WherePasses(paramFilter)
		collector2.UnionWith(collector)
elif paramId == None:
	if len(biplist) == 1:
		provider = ParameterValueProvider(ElementId(biplist[0]))
		filterrule = FilterStringRule(provider, evaluator, string , case)
		paramFilter = ElementParameterFilter(filterrule)
		collector = FilteredElementCollector(doc, doc.ActiveView.Id)
		collector.OfClass(FamilyInstance).WherePasses(paramFilter)
		collector2 = FilteredElementCollector(doc, doc.ActiveView.Id)
		collector2.OfClass(HostObject).WherePasses(paramFilter)
		collector2.UnionWith(collector)
	else:
		provider = ParameterValueProvider(ElementId(biplist[0]))
		filterrule = FilterStringRule(provider, evaluator, string , case)
		paramFilter = ElementParameterFilter(filterrule)
		collector = FilteredElementCollector(doc, doc.ActiveView.Id)
		collector.OfClass(FamilyInstance).WherePasses(paramFilter)
		collector2 = FilteredElementCollector(doc, doc.ActiveView.Id)
		collector2.OfClass(HostObject).WherePasses(paramFilter)
		collector2.UnionWith(collector)
		for i,param in enumerate(biplist):
			if i == 0:
				continue
			provider = ParameterValueProvider(ElementId(param))
			filterrule = FilterStringRule(provider, evaluator, string , case)
			paramFilter = ElementParameterFilter(filterrule)
			tempcollector1 = FilteredElementCollector(doc, doc.ActiveView.Id)
			tempcollector1.OfClass(FamilyInstance).WherePasses(paramFilter)
			tempcollector2 = FilteredElementCollector(doc, doc.ActiveView.Id)
			tempcollector2.OfClass(HostObject).WherePasses(paramFilter)
			tempcollector2.UnionWith(tempcollector1)
			collector2.UnionWith(tempcollector2)
else:
	ruleslist = List[FilterRule]()
	provider = ParameterValueProvider(paramId)
	filterrule = FilterStringRule(provider, evaluator, string , case)
	ruleslist.Add(filterrule)
	ruleslist.Add(sharedparamrule)
	paramFilter = ElementParameterFilter(ruleslist)
	collector = FilteredElementCollector(doc, doc.ActiveView.Id)
	collector.OfClass(FamilyInstance).WherePasses(paramFilter)
	collector2 = FilteredElementCollector(doc, doc.ActiveView.Id)
	collector2.OfClass(HostObject).WherePasses(paramFilter)
	collector2.UnionWith(collector)
if parameter == None and paramId == None and len(biplist) == 0:
	OUT = "Does not work with non-shared family parameters"
else:
	elements = collector2.ToElements()
TransactionManager.Instance.TransactionTaskDone()
#Check Family Names of Selected, check to ensure Family Type Matches Also
try:
	elems = []
	for e in elements:
		elemTypeName = getBIPParamVal(e, BuiltInParameter.ELEM_FAMILY_AND_TYPE_PARAM)
		if famTypeToChangeName in elemTypeName:
			elems.append(e)	
except:
	import traceback
	message = traceback.format_exc()
	Output.Add(message)
#Errror List
Output = []
#Parameter Values to Manipulate
valOneOldParam = "WALL_PEN_DEPTH"
valOneNewParam = "WALL_PEN_DEPTH"
valTwoOldParam = "WALL_PEN_LENGTH"
valTwoNewParam = "WALL_PEN_LENGTH"
valThreeOldParam = "WALL_PEN_OPENING"
valThreeNewParam = "WALL_PEN_OPENING"
valFourOldParam = "BOTTOM_OPENING_AFF"
#valFourNewParam = "Rod Diameter"
#valFiveOldParam = "user filter 9"
#valFiveNewParam = "HEC_Length"
try:
	i=0
	for sE in elems:
		sEIDList = List[ElementId]()
		sEIDList.Add(sE.Id)

		ParamOneValue = sE.LookupParameter(valOneOldParam).AsDouble()
		ParamTwoValue = sE.LookupParameter(valTwoOldParam).AsDouble()
		ParamThreeValue = sE.LookupParameter(valThreeOldParam).AsDouble()
		ParamFourValue = sE.LookupParameter(valFourOldParam).AsDouble()
		#ParamFiveValue = sE.LookupParameter(valFiveOldParam).AsString()

		if sE.WorksetId != None:
			sEWorksetID = sE.WorksetId.ToString()
		
			copyElem = None
			TransactionManager.Instance.EnsureInTransaction(doc)
			copyElem = ElementTransformUtils.CopyElements(doc, sEIDList, XYZ(0,0,0))
			TransactionManager.Instance.TransactionTaskDone()
			if copyElem != None:
				for cEID in copyElem:
					cE = doc.GetElement(cEID)	
	
				offsetVal = getBIPParamValDouble(cE, BuiltInParameter.INSTANCE_FREE_HOST_OFFSET_PARAM)
			try:	
				TransactionManager.Instance.EnsureInTransaction(doc)
				cE.ChangeTypeId(ElementId(famTypeToChangeTo.Id))
				TransactionManager.Instance.TransactionTaskDone()
			
				TransactionManager.Instance.EnsureInTransaction(doc)
	
				setBIPParamVal(cE, BuiltInParameter.INSTANCE_FREE_HOST_OFFSET_PARAM, 0)
				if sE.WorksetId != None:
					setBIPParamVal(cE, BuiltInParameter.ELEM_PARTITION_PARAM, sEWorksetID)	
				#cE.LookupParameter("user filter 8").Set("Script Copy")
	
	
				cE.LookupParameter(valOneNewParam).Set(ParamOneValue)
				cE.LookupParameter(valTwoNewParam).Set(ParamTwoValue)
				cE.LookupParameter(valThreeNewParam).Set(ParamThreeValue)
				cE.LookupParameter(valFourOldParam).Set( ParamFourValue)
				#cE.LookupParameter().Set(ParamFiveValue)
	
				TransactionManager.Instance.TransactionTaskDone()
				Output.Add([cE, "Successfully Duplicated and Swapped"])
			except:
				next

			
except:
	import traceback
	message = traceback.format_exc()
	Output.Add(message)
i += 1	
try:
	OUT = i, Output, famTypeToChangeTo.Id
except:
	OUT = Output
				
	
# ----------------------------------------
get_elevation = Python(IN[0]=family_types_to_change, IN[1]=ignorecase)  # frozen
# ---------- get_elevation.python (199 lines) ----------
import clr
import sys

pyPath = r"C:\Program Files (x86)\IronPython 2.7\Lib"
sys.path.append(pyPath)

import System 
import System.Collections
#Access to Revit Document
clr.AddReference("RevitServices")
import RevitServices
#To Get Doc, UI and Application Objects
from RevitServices.Persistence import DocumentManager
#Needed to make any changes in Revit
from RevitServices.Transactions import TransactionManager
clr.AddReference("RevitNodes")
import Revit
clr.ImportExtensions(Revit.Elements)
clr.ImportExtensions(Revit.GeometryConversion)
clr.AddReference("RevitAPI")
from Autodesk.Revit.DB import *

from Autodesk.Revit.DB.Structure import *
clr.AddReference("RevitAPIUI")
from Autodesk.Revit.UI import *
from System.Collections.Generic import List
import traceback

doc = DocumentManager.Instance.CurrentDBDocument
uidoc = DocumentManager.Instance.CurrentUIDocument
app = DocumentManager.Instance.CurrentUIApplication.Application

def getParameterVal(element, parameterName):
	return element.LookupParameter(parameterName).AsValueString()
def getParameterValAsString(element, parameterName):
	return element.LookupParameter(parameterName).AsString()
	
def getParameterValDouble(element, parameterName):
	return element.LookupParameter(parameterName).AsDouble()

def setParamByName(element, parameterName, value):
	element.LookupParameter(parameterName).Set(value)
	return value
	
def getBIPParamVal(element, BIParameter):
	return element.get_Parameter(BIParameter).AsValueString()
	
def getBIPParamValAsString(element, BIParameter):
	return element.get_Parameter(BIParameter).AsString()

def getBIPParamValDouble(element, BIParameter):
	return element.get_Parameter(BIParameter).AsDouble()

def setBIPParamVal(element, BIParameter, value):
	element.get_Parameter(BIParameter).Set(value)
	return value

#Define Lists
elemTypeName = []

# The inputs to this node will be stored as a list in the IN variables.
dataEnteringNode = IN
famTypeToChange = IN[0]


#valOneParam = "Angle"
#valTwoParam = "HEC_Angle"
#valOne = getParameterValDouble(UnwrapElement(famTypeToChange), valOneParam)
#valTwo = getParameterValDouble(UnwrapElement(famTypeToChangeTo), valTwoParam)

famTypeToChangeName = famTypeToChange.Name.ToString()
famTypeToChangeFamName = UnwrapElement(famTypeToChange).FamilyName.ToString()



#No User Changes Needed till Line 207
TransactionManager.Instance.EnsureInTransaction(doc)
#Get Elements with Family Name Matching info Above
string = famTypeToChangeFamName
case = IN[1]
search = "Family"
bips = System.Enum.GetValues(BuiltInParameter)
bm = doc.ParameterBindings
bmlist = bm.ForwardIterator()
paramId = None
testout = []
while bmlist.MoveNext():
	binddef = bmlist.Key
	testout.append(binddef.Name)
	if binddef.Name == search:
		paramId = binddef.Id
		break
param = None
if paramId == None:
	biplist = []
	for bip in bips:
		try:
			name = LabelUtils.GetLabelFor(bip)
		except:
			continue
		if name == search:
			biplist.append(bip)
sharedparamrule = SharedParameterApplicableRule(search)
evaluator = FilterStringContains()
parameter = None
if paramId == None and len(biplist) == 0:
	coll = FilteredElementCollector(doc)
	sharedparams = coll.OfClass(ParameterElement)
	for param in sharedparams:
		name = param.GetDefinition().Name
		if name == search:
			parameter = param
	if parameter != None:
		ruleslist = List[FilterRule]()
		provider = ParameterValueProvider(parameter.Id)
		filterrule = FilterStringRule(provider, evaluator, string , case)
		ruleslist.Add(filterrule)
		ruleslist.Add(sharedparamrule)
		paramFilter = ElementParameterFilter(ruleslist)
		collector = FilteredElementCollector(doc, doc.ActiveView.Id)
		collector.OfClass(FamilyInstance).WherePasses(paramFilter)
		collector2 = FilteredElementCollector(doc, doc.ActiveView.Id)
		collector2.OfClass(HostObject).WherePasses(paramFilter)
		collector2.UnionWith(collector)
elif paramId == None:
	if len(biplist) == 1:
		provider = ParameterValueProvider(ElementId(biplist[0]))
		filterrule = FilterStringRule(provider, evaluator, string , case)
		paramFilter = ElementParameterFilter(filterrule)
		collector = FilteredElementCollector(doc, doc.ActiveView.Id)
		collector.OfClass(FamilyInstance).WherePasses(paramFilter)
		collector2 = FilteredElementCollector(doc, doc.ActiveView.Id)
		collector2.OfClass(HostObject).WherePasses(paramFilter)
		collector2.UnionWith(collector)
	else:
		provider = ParameterValueProvider(ElementId(biplist[0]))
		filterrule = FilterStringRule(provider, evaluator, string , case)
		paramFilter = ElementParameterFilter(filterrule)
		collector = FilteredElementCollector(doc, doc.ActiveView.Id)
		collector.OfClass(FamilyInstance).WherePasses(paramFilter)
		collector2 = FilteredElementCollector(doc, doc.ActiveView.Id)
		collector2.OfClass(HostObject).WherePasses(paramFilter)
		collector2.UnionWith(collector)
		for i,param in enumerate(biplist):
			if i == 0:
				continue
			provider = ParameterValueProvider(ElementId(param))
			filterrule = FilterStringRule(provider, evaluator, string , case)
			paramFilter = ElementParameterFilter(filterrule)
			tempcollector1 = FilteredElementCollector(doc, doc.ActiveView.Id)
			tempcollector1.OfClass(FamilyInstance).WherePasses(paramFilter)
			tempcollector2 = FilteredElementCollector(doc, doc.ActiveView.Id)
			tempcollector2.OfClass(HostObject).WherePasses(paramFilter)
			tempcollector2.UnionWith(tempcollector1)
			collector2.UnionWith(tempcollector2)
else:
	ruleslist = List[FilterRule]()
	provider = ParameterValueProvider(paramId)
	filterrule = FilterStringRule(provider, evaluator, string , case)
	ruleslist.Add(filterrule)
	ruleslist.Add(sharedparamrule)
	paramFilter = ElementParameterFilter(ruleslist)
	collector = FilteredElementCollector(doc, doc.ActiveView.Id)
	collector.OfClass(FamilyInstance).WherePasses(paramFilter)
	collector2 = FilteredElementCollector(doc, doc.ActiveView.Id)
	collector2.OfClass(HostObject).WherePasses(paramFilter)
	collector2.UnionWith(collector)
if parameter == None and paramId == None and len(biplist) == 0:
	OUT = "Does not work with non-shared family parameters"
else:
	elements = collector2.ToElements()
TransactionManager.Instance.TransactionTaskDone()
#Check Family Names of Selected, check to ensure Family Type Matches Also
try:
	elems = []
	for e in elements:
		elemTypeName = getBIPParamVal(e, BuiltInParameter.ELEM_FAMILY_AND_TYPE_PARAM)
		if famTypeToChangeName in elemTypeName:
			elems.append(e)	
except:
	import traceback
	message = traceback.format_exc()
	Output.Add(message)

for element in elements:
	heightfromLevel = element.GetTransform().Origin.Z - 0.0694444444444444
	BOTTOM_OPENING_AFF = element.LookupParameter("BOTTOM_OPENING_AFF").AsDouble()
	New_BOTTOM_OPENING_AFF = str(BOTTOM_OPENING_AFF + heightfromLevel)
	TransactionManager.Instance.EnsureInTransaction(doc)
	element.LookupParameter("user filter 9").Set(New_BOTTOM_OPENING_AFF)
	TransactionManager.Instance.TransactionTaskDone()
	
	#DoubleP = float(element.LookupParameter("user filter 9").AsString())
	#TransactionManager.Instance.EnsureInTransaction(doc)
	#element.LookupParameter("BOTTOM_OPENING_AFF").Set(DoubleP)
	#TransactionManager.Instance.TransactionTaskDone()
			
	
OUT = BOTTOM_OPENING_AFF
# ----------------------------------------
