# Dynamo graph MM - Python - Rename Families.dyn (Dynamo 2.3.2.15696)

rename_families_in_active = Python()  # "Rename Families in active project or family"; frozen
# ---------- rename_families_in_active.python (48 lines) ----------
import clr
import sys
sys.path.append('C:\Program Files (x86)\IronPython 2.7\Lib')
import System

clr.AddReference("RevitNodes")
import Revit
clr.ImportExtensions(Revit.Elements)

clr.AddReference("RevitServices")
import RevitServices
from RevitServices.Persistence import DocumentManager 
from RevitServices.Transactions import TransactionManager 
clr.AddReference("RevitAPI")

import Autodesk 
from Autodesk.Revit.DB import *

doc = DocumentManager.Instance.CurrentDBDocument


activeView = doc.ActiveView
elementFilteredELementCollector = FilteredElementCollector(doc).OfClass(FamilySymbol).WhereElementIsElementType().ToElements()
try:	
	for element in elementFilteredELementCollector:
		FamilyName = element.Family.Name

		TypeName = Element.Name.GetValue(element)
		try:

			HyphenSpaceFamilyName = FamilyName.replace(" - ", "-")
			HyphenSpaceTypeName = TypeName.replace(" - ", "-")
			NormalizeFamilyName = HyphenSpaceFamilyName.replace(" ", "_").ToUpper()
			NormalizeTypeName = HyphenSpaceTypeName.replace(" ", "_").ToUpper()
			TransactionManager.Instance.EnsureInTransaction(doc)
			t1 = element.Family.Name = NormalizeFamilyName
			t2 = element.Name = NormalizeTypeName
			TransactionManager.Instance.TransactionTaskDone()
		except:
			next
		
			
except:
	next


# Assign your output to the OUT variable.
OUT = FamilyName, TypeName, NormalizeFamilyName, NormalizeTypeName, t1, t2
# ----------------------------------------
rename_families_in_active_2 = Python()  # "Rename Families in active project or family"
# ---------- rename_families_in_active_2.python (54 lines) ----------
import clr
import sys
sys.path.append('C:\Program Files (x86)\IronPython 2.7\Lib')
import System

clr.AddReference("RevitNodes")
import Revit
clr.ImportExtensions(Revit.Elements)

clr.AddReference("RevitServices")
import RevitServices
from RevitServices.Persistence import DocumentManager 
from RevitServices.Transactions import TransactionManager 
clr.AddReference("RevitAPI")

import Autodesk 
from Autodesk.Revit.DB import *

doc = DocumentManager.Instance.CurrentDBDocument


activeView = doc.ActiveView
elementFilteredELementCollector = FilteredElementCollector(doc).OfClass(FamilySymbol).WhereElementIsElementType().ToElements()
try:	
	for element in elementFilteredELementCollector:
		try:
			FamilyName = element.Family.Name
	
			TypeName = Element.Name.GetValue(element)
		except:
			next
		try:
			if FamilyName.__contains__("_(PRECAST)"):
				NameCorrectFamilyName = FamilyName.replace("_(PRECAST)","_PRECAST")
				HyphenSpaceFamilyName = NameCorrectFamilyName.replace(" - ", "-")
			else:
				HyphenSpaceFamilyName = FamilyName.replace(" - ", "-")
			HyphenSpaceTypeName = TypeName.replace("_(PRECAST)", "_PRECAST")
			NormalizeFamilyName = HyphenSpaceFamilyName.replace(" ", "_").ToUpper()
			NormalizeTypeName = HyphenSpaceTypeName.replace(" ", "_").ToUpper()
			TransactionManager.Instance.EnsureInTransaction(doc)
			t1 = element.Family.Name = NormalizeFamilyName
			t2 = element.Name = NormalizeTypeName
			TransactionManager.Instance.TransactionTaskDone()
		except:
			next
		
			
except:
	next


# Assign your output to the OUT variable.
OUT = FamilyName, TypeName, NormalizeFamilyName, NormalizeTypeName, t1, t2
# ----------------------------------------
