# Dynamo graph MM - Python - Replace Section of Parameter Value.dyn (Dynamo 2.0.4.12684)

watch = Watch()  # graph output; unwired: arg0
code_block = CodeBlock()  # // Panel Name, FT_Elec_Conduit_Panel_From,CIM_WBS_Level_01,CIM_WBS_Full,EX_Task_ID
searchValue = StringInput("Copy to 6")  # graph input
parameter_name = StringInput("EX_Layout_Mark")  # graph input
replaceWith = StringInput("Copied from 5")  # graph input
boolean_ignore_case = BoolSelector(true)  # graph input
python_filterstringcontains = Python(IN[0]=searchValue, IN[1]=parameter_name, IN[2]=replaceWith, IN[3]=boolean_ignore_case)  # "Python: filterstringContains, Replace Value, Set Value"
# ---------- python_filterstringcontains.python (144 lines) ----------
#Portion of this script is taken from MEPover to find elements that contain section of a string in their parameter value

import clr
import System

clr.AddReference("RevitServices")
import RevitServices
from RevitServices.Persistence import DocumentManager
from RevitServices.Transactions import TransactionManager
doc = DocumentManager.Instance.CurrentDBDocument

clr.AddReference("RevitAPI")
import Autodesk
from Autodesk.Revit.DB import *

clr.AddReference("RevitNodes")
import Revit
clr.ImportExtensions(Revit.Elements)
clr.ImportExtensions(Revit.GeometryConversion)

from System.Collections.Generic import List
containString = IN[0]
parametersearch = IN[1]
replaceString = IN[2]
case = IN[3]

bips = System.Enum.GetValues(BuiltInParameter)

bm = doc.ParameterBindings
bmlist = bm.ForwardIterator()
paramId = None
testout = []
while bmlist.MoveNext():
	binddef = bmlist.Key
	testout.append(binddef.Name)
	if binddef.Name == parametersearch:
		paramId = binddef.Id
		break

param = None
if paramId == None:
	biplist = []
	for bip in bips:
		try:
			name = LabelUtils.GetLabelFor(bip)
		except:
			continue
		if name == parametersearch:
			biplist.append(bip)

sharedparamrule = SharedParameterApplicableRule(parametersearch)

evaluator = FilterStringContains()
parameter = None
if paramId == None and len(biplist) == 0:
	coll = FilteredElementCollector(doc)
	sharedparams = coll.OfClass(ParameterElement)
	
	for param in sharedparams:
		name = param.GetDefinition().Name
		if name == parametersearch:
			parameter = param
	
	if parameter != None:
		ruleslist = List[FilterRule]()
		provider = ParameterValueProvider(parameter.Id)
		filterrule = FilterStringRule(provider, evaluator, containString, case)
		ruleslist.Add(filterrule)
		ruleslist.Add(sharedparamrule)
		paramFilter = ElementParameterFilter(ruleslist)
		collector = FilteredElementCollector(doc)
		collector.OfClass(FamilyInstance).WherePasses(paramFilter)
		
		collector2 = FilteredElementCollector(doc)
		collector2.OfClass(HostObject).WherePasses(paramFilter)
		collector2.UnionWith(collector)

		
elif paramId == None:
	if len(biplist) == 1:
		provider = ParameterValueProvider(ElementId(biplist[0]))
		filterrule = FilterStringRule(provider, evaluator, containString, case)
		paramFilter = ElementParameterFilter(filterrule)
		collector = FilteredElementCollector(doc)
		collector.OfClass(FamilyInstance).WherePasses(paramFilter)
		
		collector2 = FilteredElementCollector(doc)
		collector2.OfClass(HostObject).WherePasses(paramFilter)
		collector2.UnionWith(collector)
	else:
		provider = ParameterValueProvider(ElementId(biplist[0]))
		filterrule = FilterStringRule(provider, evaluator, containString, case)
		paramFilter = ElementParameterFilter(filterrule)
		collector = FilteredElementCollector(doc)
		collector.OfClass(FamilyInstance).WherePasses(paramFilter)
		
		collector2 = FilteredElementCollector(doc)
		collector2.OfClass(HostObject).WherePasses(paramFilter)
		collector2.UnionWith(collector)
		for i,param in enumerate(biplist):
			if i == 0:
				continue
			provider = ParameterValueProvider(ElementId(param))
			filterrule = FilterStringRule(provider, evaluator, containString, case)
			paramFilter = ElementParameterFilter(filterrule)
			tempcollector1 = FilteredElementCollector(doc)
			tempcollector1.OfClass(FamilyInstance).WherePasses(paramFilter)
			tempcollector2 = FilteredElementCollector(doc)
			tempcollector2.OfClass(HostObject).WherePasses(paramFilter)
			tempcollector2.UnionWith(tempcollector1)
			collector2.UnionWith(tempcollector2)
	
else:
	ruleslist = List[FilterRule]()
	provider = ParameterValueProvider(paramId)
	filterrule = FilterStringRule(provider, evaluator, containString, case)
	ruleslist.Add(filterrule)
	ruleslist.Add(sharedparamrule)
	paramFilter = ElementParameterFilter(ruleslist)
	collector = FilteredElementCollector(doc)
	collector.OfClass(FamilyInstance).WherePasses(paramFilter)
	
	collector2 = FilteredElementCollector(doc)
	collector2.OfClass(HostObject).WherePasses(paramFilter)
	collector2.UnionWith(collector)



if parameter == None and paramId == None and len(biplist) == 0:
	OUT = "Does not work with non-shared family parameters"
else:
	elements = collector2.ToElements()
	for e in elements:
		paramVal = e.LookupParameter(parametersearch).AsString()
		paramValReplaced = paramVal.replace(containString, replaceString)
		try:
			TransactionManager.Instance.EnsureInTransaction(doc)
			setParamVal = e.LookupParameter(parametersearch).Set(paramValReplaced)
			TransactionManager.Instance.EnsureInTransaction(doc)
		except:
			OUT = "Failed"
	
OUT = "Success"
	
# ----------------------------------------
