# Dynamo graph MM - Python - Select LinkAssemblyinstance Copy to Current Model.dyn (Dynamo 2.0.4.12684)

# group: User Input
links = Links(index=15)
search_value = StringInput("P")

# group: Assemblies
getallelementsfromlinkedmodel_in = Python(IN[0]=links, IN[1]=search_value)  # "GetAllElementsFromLinkedModel IN[0]: LinkInstance IN[1]: Search Parameter OUT[0]: All Parameter Values, OUT[1]: Filtered Values Elements, OUT[2]: All Assemblies"
# ---------- getallelementsfromlinkedmodel_in.python (80 lines) ----------
import clr
clr.AddReference('ProtoGeometry')
from Autodesk.DesignScript.Geometry import *
clr.AddReference("RevitAPI")
import Autodesk
from Autodesk.Revit.DB import *
import System
import sys
pyt_path = r'C:\Program Files (x86)\IronPython 2.7\Lib'
sys.path.append(pyt_path)
from System.Collections.Generic import List
clr.AddReference('RevitNodes')
import Revit
clr.ImportExtensions(Revit.Elements)
clr.AddReference('RevitServices')
from RevitServices.Persistence import DocumentManager
from RevitServices.Transactions import TransactionManager
import traceback

#The inputs to this node will be stored as a list in the IN variable.
def singleton(x):
	if hasattr(x,'__iter__'): return x[0]
	else : return x
def tolist(x):
	if hasattr(x,'__iter__'): return x
	else : return [x]	


inputinst = UnwrapElement(singleton(IN[0]) )
inputdoc = inputinst.GetLinkDocument()

if inputdoc == None:
	doc = DocumentManager.Instance.CurrentDBDocument
elif inputdoc.GetType().ToString() == "Autodesk.Revit.DB.RevitLinkInstance":
	doc = inputdoc.GetLinkDocument()
elif inputdoc.GetType().ToString() == "Autodesk.Revit.DB.Document":
	doc = inputdoc
else: doc = None

activedoc = DocumentManager.Instance.CurrentDBDocument

searchVal = IN[1]
	
value = []
elems = []
pValueList = []



try:
	errorReport = None
	result = FilteredElementCollector(inputdoc).OfCategory(BuiltInCategory.OST_Assemblies).WhereElementIsNotElementType().ToElements()
	for e in result:
		paramVal = e.Name
		pValueList.append(paramVal)
		filteredvalue = paramVal.startswith(searchVal)
		if filteredvalue == True:
			value.append(paramVal)
			elems.append(e)	
			
				
					
					
	
except:
	# if error accurs anywhere in the process catch it
	errorReport = traceback.format_exc()

					
#Assign your output to the OUT variable
if errorReport == None:
	OUT = value, elems, pValueList
	
else:
	OUT = errorReport

	
	
	
	
# ----------------------------------------
matching_assemblies_to_filter = CodeBlock(MatchingAssemblies=getallelementsfromlinkedmodel_in) { MatchingAssemblies[1]; }
all_assemblies = CodeBlock(AllAssemblies=getallelementsfromlinkedmodel_in) { AllAssemblies[2]; }
legable_parameter_value_from = CodeBlock(parameterValue=getallelementsfromlinkedmodel_in) { parameterValue[0]; }  # "Legable Parameter Value from Filter"

code_block = CodeBlock(x=matching_assemblies_to_filter) { x[0]; }

# group (continued): Assemblies
copylinkelementtoactivemodel_in = Python(IN[0]=links, IN[1]=code_block)  # "CopyLinkElementToActiveModel, IN[0]: LinkedInstance, IN[1]: LinkedElements, OUT: LocalElements"
# ---------- copylinkelementtoactivemodel_in.python (46 lines) ----------
import clr

clr.AddReference('RevitServices')
from RevitServices.Persistence import DocumentManager
from RevitServices.Transactions import TransactionManager
doc = DocumentManager.Instance.CurrentDBDocument

clr.AddReference('RevitAPI')
from Autodesk.Revit.DB import *

from System.Collections.Generic import List

clr.AddReference('RevitNodes')
import Revit
clr.ImportExtensions(Revit.Elements)

def singleton(x):
	if hasattr(x,'__iter__'): return x[0]
	else : return x

def tolist(x):
	if hasattr(x,'__iter__'): return x
	else : return [x]


linkInst = UnwrapElement(singleton(IN[0]) )
elements = UnwrapElement(tolist(IN[1]) )

linkDoc = linkInst.GetLinkDocument()
tf1 = linkInst.GetTotalTransform()
eId = List[ElementId]()
for e in elements:
	try:
		id1 = e.Id
	except:
		continue
	eId.Add(id1)

TransactionManager.Instance.EnsureInTransaction(doc)
copy = ElementTransformUtils.CopyElements(linkDoc, eId, doc, tf1, None)
TransactionManager.Instance.TransactionTaskDone()
OUT = []
for i in copy:
	e = doc.GetElement(i)
	if e is not None:
		OUT.append(e.ToDSType(False))
# ----------------------------------------
watch = Watch(copylinkelementtoactivemodel_in)

python_script = Python(IN[0]=code_block, IN[1]=copylinkelementtoactivemodel_in, IN[2]=links)  # frozen
# ---------- python_script.python (182 lines) ----------
import clr
import System
from System.Collections.Generic import List
clr.AddReference('RevitAPI')
from Autodesk.Revit.DB import *
clr.AddReference('RevitServices')
from RevitServices.Persistence import DocumentManager
from RevitServices.Transactions import TransactionManager
clr.AddReference('RevitAPIUI')
from Autodesk.Revit.UI import *
from Autodesk.Revit import Creation
import sys
pyt_path = r'C:\Program Files (x86)\IronPython 2.7\Lib'
sys.path.append(pyt_path)


doc = DocumentManager.Instance.CurrentDBDocument
uidoc = DocumentManager.Instance.CurrentUIDocument
app = doc.Application

### The inputs to this node will be stored as a list in the IN variables.
assemblyInstanceTemplate = UnwrapElement(IN[0])
assemblyInstance = UnwrapElement(IN[1])
linkInstance = UnwrapElement(IN[2])
inputDoc = linkInstance.GetLinkDocument()

### Place your code below this line

#Process Template/Existing
"""
filterList = List[BuiltInCategory]()
filterList.Add(BuiltInCategory.OST_Assemblies)
filterList.Add(BuiltInCategory.OST_Schedules)
filterList.Add(BuiltInCategory.OST_Sheets)
filterList.Add(BuiltInCategory.OST_Views)
filter = ElementMulticategoryFilter(filterList)
dependentElements = assemblyInstanceTemplate.GetDependentElements(filter)
"""
templateAssemblyName = assemblyInstanceTemplate.Name
filterAssemblies = ElementCategoryFilter(BuiltInCategory.OST_Assemblies)
filterSchedules = ElementCategoryFilter(BuiltInCategory.OST_Schedules)
filterScheduleSheetInstances = ElementCategoryFilter(BuiltInCategory.OST_ScheduleGraphics)
filterSheets = ElementCategoryFilter(BuiltInCategory.OST_Sheets)
filterViews = ElementCategoryFilter(BuiltInCategory.OST_Views)

dependentElementsAssemblies = assemblyInstanceTemplate.GetDependentElements(filterAssemblies)
dependentElementsSchedules = assemblyInstanceTemplate.GetDependentElements(filterSchedules)
dependentElementsScheduleSheetInstances = assemblyInstanceTemplate.GetDependentElements(filterScheduleSheetInstances)
dependentElementsSheets = assemblyInstanceTemplate.GetDependentElements(filterSheets)
dependentElementsViews = assemblyInstanceTemplate.GetDependentElements(filterViews)

#Process Sheet
templateSheet = inputDoc.GetElement(dependentElementsSheets[0])
templateSheetNumber = templateSheet.SheetNumber
templateSheetName = templateSheet.Name
filterTitleBlocks = ElementCategoryFilter(BuiltInCategory.OST_TitleBlocks)
templateSheetTitleBlockInstanceId = templateSheet.GetDependentElements(filterTitleBlocks)[0]
templateSheetTitleBlock = inputDoc.GetElement(templateSheetTitleBlockInstanceId)
templateSheetTitleBlockTypeId = templateSheetTitleBlock.GetTypeId()
dependentElementsViewports = templateSheet.GetAllViewports()

#Process Schedule
templateSchedule = next(inputDoc.GetElement(s) for s in dependentElementsSchedules if inputDoc.GetElement(s).Name != "")
templateScheduleSheetInstance = next(inputDoc.GetElement(s) for s in dependentElementsScheduleSheetInstances if inputDoc.GetElement(s).Name != "")
templateScheduleSheetInstancePoint = templateScheduleSheetInstance.Point

#Process Views
templateThreeDView = next(inputDoc.GetElement(v) for v in dependentElementsViews if inputDoc.GetElement(v).ViewType == ViewType.ThreeD)
templateThreeDViewport = next(inputDoc.GetElement(v) for v in dependentElementsViewports if inputDoc.GetElement(v).ViewId == templateThreeDView.Id)
templateThreeDViewportBoxCenter = templateThreeDViewport.GetBoxCenter()
templateThreeDViewportTypeId = templateThreeDViewport.GetTypeId()

templatePlanView = next(inputDoc.GetElement(v) for v in dependentElementsViews if "Plan" in inputDoc.GetElement(v).Name)
templatePlanViewport = next(inputDoc.GetElement(v) for v in dependentElementsViewports if inputDoc.GetElement(v).ViewId == templatePlanView.Id)
templatePlanViewportBoxCenter = templatePlanViewport.GetBoxCenter()
templatePlanViewportTypeId = templatePlanViewport.GetTypeId()

templateFrontView = next(inputDoc.GetElement(v) for v in dependentElementsViews if "Front" in inputDoc.GetElement(v).Name)
templateFrontViewport = next(inputDoc.GetElement(v) for v in dependentElementsViewports if inputDoc.GetElement(v).ViewId == templateFrontView.Id)
templateFrontViewportBoxCenter = templateFrontViewport.GetBoxCenter()
templateFrontViewportTypeId = templateFrontViewport.GetTypeId()

templateRightView = next(inputDoc.GetElement(v) for v in dependentElementsViews if "Right" in inputDoc.GetElement(v).Name)
templateRightViewport = next(inputDoc.GetElement(v) for v in dependentElementsViewports if inputDoc.GetElement(v).ViewId == templateRightView.Id)
templateRightViewportBoxCenter = templateRightViewport.GetBoxCenter()
templateRightViewportTypeId = templateRightViewport.GetTypeId()

#Create New
assemblyName = assemblyInstance.Name
viewCreationAllowed = assemblyInstance.AllowsAssemblyViewCreation()

if viewCreationAllowed:
	#Create Sheet
	TransactionManager.Instance.EnsureInTransaction(doc)
	assemblySheet = AssemblyViewUtils.CreateSheet(doc, assemblyInstance.Id, templateSheetTitleBlockTypeId)
	assemblySheet.GetParameters("Sheet Name")[0].Set(assemblyName)
	sheetCreatedMessage = "Sheet created: " + \
						  assemblySheet.SheetNumber + \
						  " - " + \
						  assemblySheet.GetParameters("Sheet Name")[0].AsString()
	TransactionManager.Instance.EnsureInTransaction(doc)
	
	#Create Schedule
	TransactionManager.Instance.EnsureInTransaction(doc)
	templateScheduleViewTemplate = templateSchedule.CreateViewTemplate()
	assemblySchedule = AssemblyViewUtils.CreatePartList(doc, assemblyInstance.Id, templateScheduleViewTemplate.Id, False)
	doc.Delete(templateScheduleViewTemplate.Id)
	scheduleCreatedMessage = "Schedule created: " + assemblySchedule.Name
	TransactionManager.Instance.EnsureInTransaction(doc)
	
	#Create 3D View
	TransactionManager.Instance.EnsureInTransaction(doc)
	templateThreeDViewTemplate = templateThreeDView.CreateViewTemplate()
	assemblyThreeDView = AssemblyViewUtils.Create3DOrthographic(doc, assemblyInstance.Id, templateThreeDViewTemplate.Id, False)
	doc.Delete(templateThreeDViewTemplate.Id)
	threeDViewCreatedMessage = "3D view created: " + assemblyThreeDView.Name
	TransactionManager.Instance.EnsureInTransaction(doc)
	
	#Create Plan View
	TransactionManager.Instance.EnsureInTransaction(doc)
	templatePlanViewTemplate = templatePlanView.CreateViewTemplate()
	planViewDirection = AssemblyDetailViewOrientation.HorizontalDetail
	assemblyPlanView = AssemblyViewUtils.CreateDetailSection(doc, assemblyInstance.Id, planViewDirection, templatePlanViewTemplate.Id, False)
	doc.Delete(templatePlanViewTemplate.Id)
	planViewCreatedMessage = "Plan view created: " + assemblyPlanView.Name
	TransactionManager.Instance.EnsureInTransaction(doc)
	
	#Create Front View
	TransactionManager.Instance.EnsureInTransaction(doc)
	templateFrontViewTemplate = templateFrontView.CreateViewTemplate()
	frontViewDirection = AssemblyDetailViewOrientation.ElevationFront
	assemblyFrontView = AssemblyViewUtils.CreateDetailSection(doc, assemblyInstance.Id, frontViewDirection, templateFrontViewTemplate.Id, False)
	doc.Delete(templateFrontViewTemplate.Id)
	frontViewCreatedMessage = "Front view created: " + assemblyFrontView.Name
	TransactionManager.Instance.EnsureInTransaction(doc)
	
	#Create Right View
	TransactionManager.Instance.EnsureInTransaction(doc)
	templateRightViewTemplate = templateRightView.CreateViewTemplate()
	rightViewDirection = AssemblyDetailViewOrientation.ElevationRight
	assemblyRightView = AssemblyViewUtils.CreateDetailSection(doc, assemblyInstance.Id, rightViewDirection, templateRightViewTemplate.Id, False)
	doc.Delete(templateRightViewTemplate.Id)
	rightViewCreatedMessage = "Right view created: " + assemblyRightView.Name
	TransactionManager.Instance.EnsureInTransaction(doc)
	
	#Add Schedule To Sheet
	assemblySchedulSheetInstance = ScheduleSheetInstance.Create(doc, assemblySheet.Id, assemblySchedule.Id, templateScheduleSheetInstancePoint)
	#assemblySchedulSheetInstance.Point = templateScheduleSheetInstancePoint
	
	#Add 3D View To Sheet
	assemblyThreeDViewport = Viewport.Create(doc, assemblySheet.Id, assemblyThreeDView.Id, templateThreeDViewportBoxCenter)
	assemblyThreeDViewport.ChangeTypeId(templateThreeDViewportTypeId)
	
	#Add Plan View To Sheet
	assemblyPlanViewport = Viewport.Create(doc, assemblySheet.Id, assemblyPlanView.Id, templatePlanViewportBoxCenter)
	assemblyPlanViewport.ChangeTypeId(templatePlanViewportTypeId)
	
	#Add Front View To Sheet
	assemblyFrontViewport = Viewport.Create(doc, assemblySheet.Id, assemblyFrontView.Id, templateFrontViewportBoxCenter)
	assemblyFrontViewport.ChangeTypeId(templateFrontViewportTypeId)
	
	#Add Right View To Sheet
	assemblyRightViewport = Viewport.Create(doc, assemblySheet.Id, assemblyRightView.Id, templateRightViewportBoxCenter)
	assemblyRightViewport.ChangeTypeId(templateRightViewportTypeId)


### Assign your output to the OUT variable.
OUT = templateAssemblyName, \
	dependentElementsAssemblies, \
	dependentElementsSchedules, \
	dependentElementsScheduleSheetInstances, \
	dependentElementsSheets, \
	dependentElementsViews, \
	dependentElementsViewports, \
	assemblyName, \
	viewCreationAllowed, \
	sheetCreatedMessage, \
	scheduleCreatedMessage, \
	threeDViewCreatedMessage, \
	frontViewCreatedMessage, \
	rightViewCreatedMessage
	  
# ----------------------------------------
watch_2 = Watch(python_script)
watch_3 = Watch(all_assemblies)
watch_4 = Watch(legable_parameter_value_from)
python_script_2 = Python()  # unwired: IN[0], IN[1]
# ---------- python_script_2.python (175 lines) ----------
import clr
import System
from System.Collections.Generic import List
clr.AddReference('RevitAPI')
from Autodesk.Revit.DB import *
clr.AddReference('RevitServices')
from RevitServices.Persistence import DocumentManager
from RevitServices.Transactions import TransactionManager
clr.AddReference('RevitAPIUI')
from Autodesk.Revit.UI import *
from Autodesk.Revit import Creation

doc = DocumentManager.Instance.CurrentDBDocument
uidoc = DocumentManager.Instance.CurrentUIDocument
app = doc.Application

### The inputs to this node will be stored as a list in the IN variables.
assemblyInstanceTemplate = UnwrapElement(IN[0])
assemblyInstance = UnwrapElement(IN[1])

### Place your code below this line

#Process Template/Existing
"""
filterList = List[BuiltInCategory]()
filterList.Add(BuiltInCategory.OST_Assemblies)
filterList.Add(BuiltInCategory.OST_Schedules)
filterList.Add(BuiltInCategory.OST_Sheets)
filterList.Add(BuiltInCategory.OST_Views)
filter = ElementMulticategoryFilter(filterList)
dependentElements = assemblyInstanceTemplate.GetDependentElements(filter)
"""
templateAssemblyName = assemblyInstanceTemplate.Name
filterAssemblies = ElementCategoryFilter(BuiltInCategory.OST_Assemblies)
filterSchedules = ElementCategoryFilter(BuiltInCategory.OST_Schedules)
filterScheduleSheetInstances = ElementCategoryFilter(BuiltInCategory.OST_ScheduleGraphics)
filterSheets = ElementCategoryFilter(BuiltInCategory.OST_Sheets)
filterViews = ElementCategoryFilter(BuiltInCategory.OST_Views)

dependentElementsAssemblies = assemblyInstanceTemplate.GetDependentElements(filterAssemblies)
dependentElementsSchedules = assemblyInstanceTemplate.GetDependentElements(filterSchedules)
dependentElementsScheduleSheetInstances = assemblyInstanceTemplate.GetDependentElements(filterScheduleSheetInstances)
dependentElementsSheets = assemblyInstanceTemplate.GetDependentElements(filterSheets)
dependentElementsViews = assemblyInstanceTemplate.GetDependentElements(filterViews)

#Process Sheet
templateSheet = doc.GetElement(dependentElementsSheets[0])
templateSheetNumber = templateSheet.SheetNumber
templateSheetName = templateSheet.Name
filterTitleBlocks = ElementCategoryFilter(BuiltInCategory.OST_TitleBlocks)
templateSheetTitleBlockInstanceId = templateSheet.GetDependentElements(filterTitleBlocks)[0]
templateSheetTitleBlock = doc.GetElement(templateSheetTitleBlockInstanceId)
templateSheetTitleBlockTypeId = templateSheetTitleBlock.GetTypeId()
dependentElementsViewports = templateSheet.GetAllViewports()

#Process Schedule
templateSchedule = next(doc.GetElement(s) for s in dependentElementsSchedules if doc.GetElement(s).Name == "Part List")
templateScheduleSheetInstance = next(doc.GetElement(s) for s in dependentElementsScheduleSheetInstances if doc.GetElement(s).Name == "Part List")
templateScheduleSheetInstancePoint = templateScheduleSheetInstance.Point

#Process Views
templateThreeDView = next(doc.GetElement(v) for v in dependentElementsViews if doc.GetElement(v).ViewType == ViewType.ThreeD)
templateThreeDViewport = next(doc.GetElement(v) for v in dependentElementsViewports if doc.GetElement(v).ViewId == templateThreeDView.Id)
templateThreeDViewportBoxCenter = templateThreeDViewport.GetBoxCenter()
templateThreeDViewportTypeId = templateThreeDViewport.GetTypeId()

templatePlanView = next(doc.GetElement(v) for v in dependentElementsViews if "Plan" in doc.GetElement(v).Name)
templatePlanViewport = next(doc.GetElement(v) for v in dependentElementsViewports if doc.GetElement(v).ViewId == templatePlanView.Id)
templatePlanViewportBoxCenter = templatePlanViewport.GetBoxCenter()
templatePlanViewportTypeId = templatePlanViewport.GetTypeId()

templateFrontView = next(doc.GetElement(v) for v in dependentElementsViews if "Front" in doc.GetElement(v).Name)
templateFrontViewport = next(doc.GetElement(v) for v in dependentElementsViewports if doc.GetElement(v).ViewId == templateFrontView.Id)
templateFrontViewportBoxCenter = templateFrontViewport.GetBoxCenter()
templateFrontViewportTypeId = templateFrontViewport.GetTypeId()

templateRightView = next(doc.GetElement(v) for v in dependentElementsViews if "Right" in doc.GetElement(v).Name)
templateRightViewport = next(doc.GetElement(v) for v in dependentElementsViewports if doc.GetElement(v).ViewId == templateRightView.Id)
templateRightViewportBoxCenter = templateRightViewport.GetBoxCenter()
templateRightViewportTypeId = templateRightViewport.GetTypeId()

#Create New
assemblyName = assemblyInstance.Name
viewCreationAllowed = assemblyInstance.AllowsAssemblyViewCreation()

if viewCreationAllowed:
	#Create Sheet
	TransactionManager.Instance.EnsureInTransaction(doc)
	assemblySheet = AssemblyViewUtils.CreateSheet(doc, assemblyInstance.Id, templateSheetTitleBlockTypeId)
	assemblySheet.GetParameters("Sheet Name")[0].Set(assemblyName)
	sheetCreatedMessage = "Sheet created: " + \
						  assemblySheet.SheetNumber + \
						  " - " + \
						  assemblySheet.GetParameters("Sheet Name")[0].AsString()
	TransactionManager.Instance.EnsureInTransaction(doc)

	#Create Schedule
	TransactionManager.Instance.EnsureInTransaction(doc)
	templateScheduleViewTemplate = templateSchedule.CreateViewTemplate()
	assemblySchedule = AssemblyViewUtils.CreatePartList(doc, assemblyInstance.Id, templateScheduleViewTemplate.Id, False)
	doc.Delete(templateScheduleViewTemplate.Id)
	scheduleCreatedMessage = "Schedule created: " + assemblySchedule.Name
	TransactionManager.Instance.EnsureInTransaction(doc)
	
	#Create 3D View
	TransactionManager.Instance.EnsureInTransaction(doc)
	templateThreeDViewTemplate = templateThreeDView.CreateViewTemplate()
	assemblyThreeDView = AssemblyViewUtils.Create3DOrthographic(doc, assemblyInstance.Id, templateThreeDViewTemplate.Id, False)
	doc.Delete(templateThreeDViewTemplate.Id)
	threeDViewCreatedMessage = "3D view created: " + assemblyThreeDView.Name
	TransactionManager.Instance.EnsureInTransaction(doc)
	
	#Create Plan View
	TransactionManager.Instance.EnsureInTransaction(doc)
	templatePlanViewTemplate = templatePlanView.CreateViewTemplate()
	planViewDirection = AssemblyDetailViewOrientation.HorizontalDetail
	assemblyPlanView = AssemblyViewUtils.CreateDetailSection(doc, assemblyInstance.Id, planViewDirection, templatePlanViewTemplate.Id, False)
	doc.Delete(templatePlanViewTemplate.Id)
	planViewCreatedMessage = "Plan view created: " + assemblyPlanView.Name
	TransactionManager.Instance.EnsureInTransaction(doc)
	
	#Create Front View
	TransactionManager.Instance.EnsureInTransaction(doc)
	templateFrontViewTemplate = templateFrontView.CreateViewTemplate()
	frontViewDirection = AssemblyDetailViewOrientation.ElevationFront
	assemblyFrontView = AssemblyViewUtils.CreateDetailSection(doc, assemblyInstance.Id, frontViewDirection, templateFrontViewTemplate.Id, False)
	doc.Delete(templateFrontViewTemplate.Id)
	frontViewCreatedMessage = "Front view created: " + assemblyFrontView.Name
	TransactionManager.Instance.EnsureInTransaction(doc)
	
	#Create Right View
	TransactionManager.Instance.EnsureInTransaction(doc)
	templateRightViewTemplate = templateRightView.CreateViewTemplate()
	rightViewDirection = AssemblyDetailViewOrientation.ElevationRight
	assemblyRightView = AssemblyViewUtils.CreateDetailSection(doc, assemblyInstance.Id, rightViewDirection, templateRightViewTemplate.Id, False)
	doc.Delete(templateRightViewTemplate.Id)
	rightViewCreatedMessage = "Right view created: " + assemblyRightView.Name
	TransactionManager.Instance.EnsureInTransaction(doc)
	
	#Add Schedule To Sheet
	assemblySchedulSheetInstance = ScheduleSheetInstance.Create(doc, assemblySheet.Id, assemblySchedule.Id, templateScheduleSheetInstancePoint)
	#assemblySchedulSheetInstance.Point = templateScheduleSheetInstancePoint
	
	#Add 3D View To Sheet
	assemblyThreeDViewport = Viewport.Create(doc, assemblySheet.Id, assemblyThreeDView.Id, templateThreeDViewportBoxCenter)
	assemblyThreeDViewport.ChangeTypeId(templateThreeDViewportTypeId)
	
	#Add Plan View To Sheet
	assemblyPlanViewport = Viewport.Create(doc, assemblySheet.Id, assemblyPlanView.Id, templatePlanViewportBoxCenter)
	assemblyPlanViewport.ChangeTypeId(templatePlanViewportTypeId)
	
	#Add Front View To Sheet
	assemblyFrontViewport = Viewport.Create(doc, assemblySheet.Id, assemblyFrontView.Id, templateFrontViewportBoxCenter)
	assemblyFrontViewport.ChangeTypeId(templateFrontViewportTypeId)
	
	#Add Right View To Sheet
	assemblyRightViewport = Viewport.Create(doc, assemblySheet.Id, assemblyRightView.Id, templateRightViewportBoxCenter)
	assemblyRightViewport.ChangeTypeId(templateRightViewportTypeId)

### Assign your output to the OUT variable.
OUT = templateAssemblyName, \
	  dependentElementsAssemblies, \
	  dependentElementsSchedules, \
	  dependentElementsScheduleSheetInstances, \
	  dependentElementsSheets, \
	  dependentElementsViews, \
	  dependentElementsViewports, \
	  assemblyName, \
	  viewCreationAllowed, \
	  sheetCreatedMessage, \
	  scheduleCreatedMessage, \
	  threeDViewCreatedMessage, \
	  frontViewCreatedMessage, \
	  rightViewCreatedMessage
	  
# ----------------------------------------
