# Dynamo graph MM - Python - Select linked elements copy to current model.dyn (Dynamo 2.0.4.12684)

boolean = BoolSelector(false)
get_link_elements_copy_to = Python(IN[0]=boolean)  # "Get Link Elements, copy to current model"
# ---------- get_link_elements_copy_to.python (56 lines) ----------
# Copyright(c) 2017, Dimitar Venkov
# @5devene, dimitar.ven@gmail.com
# www.badmonkeys.net
# Adjusted to work solely in Python by Mike Meyers, MikeM_134@hotmail.com

import clr

clr.AddReference("RevitAPIUI")
from Autodesk.Revit.UI import *

clr.AddReference("RevitAPI")
from Autodesk.Revit.DB import *

clr.AddReference("RevitServices")
import RevitServices
from RevitServices.Persistence import DocumentManager
from RevitServices.Transactions import TransactionManager
doc = DocumentManager.Instance.CurrentDBDocument
uidoc = DocumentManager.Instance.CurrentUIApplication.ActiveUIDocument

clr.AddReference("RevitNodes")
import Revit
clr.ImportExtensions(Revit.Elements)
clr.ImportExtensions(Revit.GeometryConversion)
from System.Collections.Generic import List


sel1 = uidoc.Selection
ot1 = Selection.ObjectType.Element
ot2 = Selection.ObjectType.LinkedElement
li_ref = sel1.PickObject(ot1, "Select a link instance first.")
link1 = doc.GetElement(li_ref.ElementId)
if isinstance(link1, RevitLinkInstance):
	el_ref = sel1.PickObjects(ot2, "Select the linked elements and press Finish.")
	linkDoc = link1.GetLinkDocument()
	Lel_id = [r1.LinkedElementId for r1 in el_ref]
	tf1 = link1.GetTotalTransform()
	
else:
	OUT = "Failed to pick a linked instance", None
	
eId = List[ElementId]()
for e in Lel_id:
	
	eId.Add(e)
	
TransactionManager.Instance.EnsureInTransaction(doc)
copy = ElementTransformUtils.CopyElements(linkDoc, eId, doc, tf1, None)
TransactionManager.Instance.TransactionTaskDone()
OUT = []
for i in copy:
	e = doc.GetElement(i)
	if e is not None:
		OUT.append(e.ToDSType(False))	
	
	
# ----------------------------------------
