# Dynamo graph MM - Python - Set View Filter by Name.dyn (Dynamo 2.12.0.5650)

search_value = StringInput("Seismic Hangers SQD")  # graph input
parameter_string = StringInput("Sub-Discipline")  # graph input
view_filter_name = StringInput("SQD Seismic and Supplemental")  # graph input
python_script = Python(IN[0]=search_value, IN[1]=parameter_string, IN[2]=view_filter_name)  # IronPython2
# ---------- python_script.python (41 lines) ----------
import clr
import System

clr.AddReference("RevitServices")
import RevitServices
from RevitServices.Persistence import DocumentManager
from RevitServices.Transactions import TransactionManager
doc = DocumentManager.Instance.CurrentDBDocument

clr.AddReference("RevitAPI")
import Autodesk
from Autodesk.Revit.DB import *

clr.AddReference("RevitNodes")
import Revit
clr.ImportExtensions(Revit.Elements)
clr.ImportExtensions(Revit.GeometryConversion)

from System.Collections.Generic import List
searchValue = IN[0]
paramName = IN[1]
viewFilterName = IN[2]

viewElems = FilteredElementCollector(doc).OfCategory(BuiltInCategory.OST_Views).WhereElementIsNotElementType().ToElements()
viewFilters = FilteredElementCollector(doc).OfClass(ParameterFilterElement).WhereElementIsNotElementType().ToElements()
t0 = []
t1 = []
for vF in viewFilters:
	filter = vF.Name
	if filter == viewFilterName:
		for vE in viewElems:
		    view = vE.LookupParameter(paramName).AsValueString()
		    if view == searchValue: 
				TransactionManager.Instance.EnsureInTransaction(doc)    
				vE.AddFilter(vF.Id)
				vE.SetFilterVisibility(vF.Id, False);
				
				TransactionManager.Instance.TransactionTaskDone()


OUT = "Success"
# ----------------------------------------
