# Dynamo graph MM - Python - Tag Unique Conduit Run Number in Active View.dyn (Dynamo 2.0.4.12684)

choose_the_annotation_family = FamilyTypes(index=53)  # "Choose the Annotation Family that aligns with the parameter chosen"; graph input
parameter_name = StringInput("EX_Elec_Conduit_Run_Number")  # graph input
in_active_view_get_all_elements = Python(IN[0]=choose_the_annotation_family, IN[1]=parameter_name)  # "In Active View, get all Elements, filter by parameter Value, Get Unique and Tag"
# ---------- in_active_view_get_all_elements.python (72 lines) ----------
import clr
import System

clr.AddReference("RevitServices")
import RevitServices
from RevitServices.Persistence import DocumentManager
from RevitServices.Transactions import TransactionManager

doc = DocumentManager.Instance.CurrentDBDocument
uiapp = DocumentManager.Instance.CurrentUIApplication
app = uiapp.Application

clr.AddReference("RevitAPI")
import Autodesk
from Autodesk.Revit.DB import *

clr.AddReference("RevitNodes")
import Revit
clr.ImportExtensions(Revit.Elements)

from System.Collections.Generic import List
import re
import sys
pyt_path = r'C:\Program Files (x86)\IronPython 2.7\Lib'
sys.path.append(pyt_path)
import traceback

# The inputs to this node will be stored as a list in the IN variables.
dataEnteringNode = IN
annoFamName = UnwrapElement(IN[0])
paramName = str(IN[1])


eHPUnique = []
toClean = []
elemRef = []
elem = []
t0 = []

activeViewId = doc.ActiveView.Id
activeViewElems = FilteredElementCollector(doc,doc.ActiveView.Id).WhereElementIsNotElementType().ToElements()
tagOrientation = TagOrientation.Horizontal

aFNId = annoFamName.Id
t0.append(annoFamName)
for aVE in activeViewElems:
	elemHasParam = aVE.LookupParameter(paramName)
	if elemHasParam != None:
		if elemHasParam.AsString() != "":
			toClean.append(elemHasParam.AsString())
			for sublist in toClean:
				if sublist not in eHPUnique:
					eHPUnique.append(sublist)
					elemRef.append(Reference(aVE))
					elem.append(aVE)
for eR,e in zip(elemRef,elem):
	ePoint = e.Location.Point
	#adjustByXYZ = XYZ(0.5, 0.5, 0) 
	#newXYZ = ePoint + adjustByXYZ
	TransactionManager.Instance.EnsureInTransaction(doc)
	newTag = IndependentTag.Create(doc, aFNId, activeViewId, eR, True, tagOrientation, ePoint)
	TransactionManager.Instance.TransactionTaskDone()
	
	
	#tagBoundingBox = newTag.BoundingBox
	#tagFree = LeaderEndCondition.Free
	#newTag.LeaderEndCondition = tagFree
	#newTag.LeaderEnd = ePoint


# Assign your output to the OUT variable.
OUT = "Success" 
# ----------------------------------------
watch = Watch(in_active_view_get_all_elements)
