# Dynamo graph MM - Python - Tag Unique Parameter Value in Active View.dyn (Dynamo 2.0.4.12684)

choose_the_annotation_family = FamilyTypes(index=53)  # "Choose the Annotation Family that aligns with the parameter chosen"; graph input
parameter_name = StringInput("EX_Elec_Conduit_Run_Number")  # graph input
in_active_view_get_all_elements = Python(IN[0]=choose_the_annotation_family, IN[1]=parameter_name)  # "In Active View, get all Elements, filter by parameter Value, Get Unique and Tag"
# ---------- in_active_view_get_all_elements.python (114 lines) ----------
import clr

clr.AddReference('DSCoreNodes')
from DSCore import Math

import System

clr.AddReference("RevitServices")
import RevitServices
from RevitServices.Persistence import DocumentManager
from RevitServices.Transactions import TransactionManager

doc = DocumentManager.Instance.CurrentDBDocument
uiapp = DocumentManager.Instance.CurrentUIApplication
app = uiapp.Application

clr.AddReference("RevitAPI")
import Autodesk
from Autodesk.Revit.DB import *

clr.AddReference("RevitNodes")
import Revit
clr.ImportExtensions(Revit.Elements)

from System.Collections.Generic import List
import re
import sys
pyt_path = r'C:\Program Files (x86)\IronPython 2.7\Lib'
sys.path.append(pyt_path)
import traceback

# The inputs to this node will be stored as a list in the IN variables.
dataEnteringNode = IN
annoFamName = UnwrapElement(IN[0])
paramName = IN[1]


eHPUnique = []
toClean = []
elemRef = []
elem = []
ePoints = []

activeView = doc.ActiveView
activeViewId = activeView.Id
activeViewElems = FilteredElementCollector(doc,doc.ActiveView.Id).WhereElementIsNotElementType().ToElements()
tagOrientation = TagOrientation.Horizontal

aFNId = annoFamName.Id
for aVE in activeViewElems:
	elemHasParam = aVE.LookupParameter(paramName)
	if elemHasParam != None:
		if elemHasParam.AsString() >= "":
			toClean.append(elemHasParam.AsString())
			for sublist in toClean:
				if sublist not in eHPUnique:
					eHPUnique.append(sublist)
					elem.append(aVE)

for e in elem:
	if e.Location.GetType() == LocationPoint:
		eP = e.Location.Point
		ePoints.Add(eP)
		elemRef.Add(Reference(e))
	
	else:
		ePoint = e.Location.Curve.Origin
		ePoints.Add(eP)
		elemRef.Add(Reference(e))
		

for eR,ePoint in zip(elemRef,ePoints):
	tagLeader = True
	
	TransactionManager.Instance.EnsureInTransaction(doc)
	newTag = IndependentTag.Create(doc, aFNId, activeViewId, eR, tagLeader, tagOrientation, ePoint)
	TransactionManager.Instance.TransactionTaskDone()
	tagBB = newTag.get_BoundingBox(activeView)
	textStart = XYZ.Zero
	lineEnd = XYZ.Zero
	center = (tagBB.Max + tagBB.Min) / 2
	centerToEdgeX = center.X - tagBB.Min.X
	centerToEdgeY = center.Y - tagBB.Min.Y
	offset = 2
	adjustedOffset = offset * (activeView.Scale / 48)
	try:
		if (Math.Abs(e.FacingOrientation.Y) == 1):
			textStart = ePoint.Add(XYZ(0.0, centerToEdgeY + adjustedOffset, 0.0))
			lineEnd = ePoint.Add(XYZ(0.0, centerToEdgeY, 0.0))
			
		elif (Math.Abs(e.FacingOrientation.X) == 1):
			textStart = ePoint.Add(XYZ(0.0, centerToEdgeX + adjustedOffset, 0.0))
			lineEnd = ePoint.Add(XYZ(0.0, centerToEdgeX, 0.0))
			
		elif (Math.Abs(e.FacingOrientation.Y) > 0.5):
			textStart = ePoint.Add(XYZ(centerToEdgeX - adjustedOffset, 0.0, 0.0))
			lineEnd = ePoint.Add(XYZ(0.0, 0.0, 0.0))
		else:
			textStart = ePoint.Add(XYZ(centerToEdgeY - adjustedOffset, 0.0, 0.0))
			lineEnd = ePoint.Add(XYZ(0.0, 0.0, 0.0))
	except: 
		OUT = "Good Try"

	TransactionManager.Instance.EnsureInTransaction(doc)
	tagFree = LeaderEndCondition.Free
	newTag.LeaderEndCondition = tagFree
	newTag.LeaderEnd = lineEnd
	newTag.TagHeadPosition = ePoint + XYZ(2.5,5.0,0.0) 
	newTag.LeaderElbow = ePoint + XYZ(0.0,5.0,0.0) 
	TransactionManager.Instance.TransactionTaskDone()


OUT = "Success"
		
# ----------------------------------------
