# Dynamo graph MM - Python-By Workset Get Parameter Values.dyn "MM - Python - By Workset Get Parameter Values" (Dynamo 2.0.4.12684)

refresh_boolean = BoolSelector(false)  # graph input
parameterName = StringInput("GTP_PointNumber_")  # graph input
parameterValue = StringInput("")  # graph input
pre_select_elements_parameters = Python(IN[0]=refresh_boolean, IN[1]=parameterName, IN[2]=parameterValue)  # "Pre Select elements, Parameters name starts with, set parameter value"
# ---------- pre_select_elements_parameters.python (82 lines) ----------
import sys
import clr
clr.AddReference('ProtoGeometry')
from Autodesk.DesignScript.Geometry import *

clr.AddReference('RevitAPI')
from Autodesk.Revit.DB import *
import Autodesk.Revit.DB as DB
from Autodesk.Revit.DB.Structure import *
clr.AddReference('RevitAPIUI')

clr.AddReference('System')
from System.Collections.Generic import List

clr.AddReference("RevitNodes")
import Revit
clr.ImportExtensions(Revit.GeometryConversion)
clr.ImportExtensions(Revit.Elements)

from Revit.Elements import *

clr.AddReference("RevitServices")
import RevitServices
from RevitServices.Persistence import DocumentManager
from RevitServices.Transactions import TransactionManager

doc = DocumentManager.Instance.CurrentDBDocument
uiapp = DocumentManager.Instance.CurrentUIApplication
app = uiapp.Application
uidoc = uiapp.ActiveUIDocument

paramName = IN[1]
paramValue = IN[2]


TransactionManager.Instance.EnsureInTransaction(doc)

selected = uidoc.Selection

booSel = selected.IsValidObject
if booSel == True:
	selectedIds = selected.GetElementIds()

#Create Lists	
elements, eParameters, ePString, parameterIds, filteredParam, filteredParams,newParamValue, = [],[],[],[],[],[],[]
#start of for loops 
for e in selectedIds:
	elem = doc.GetElement(e).ToDSType(True)
	if elem != None:
		elements.append(elem)
for eP in elements:
	eParams = eP.Parameters
	eParameters.append(eParams)
	for p in eParams:
		pNames = p.ToString()
		ePString.append(pNames)
for pC in ePString:
	pCList = pC.startswith(paramName)
	if pCList == True:
		filteredParam.append(pC[0:17])
	else:
		if pCList == None:
			filteredParam.append("Parameter Name not found, Try Again")
for eP in selectedIds:
	elems = doc.GetElement(eP)
	for fP in filteredParam:
		fParam =  elems.LookupParameter(fP)
		if fParam != None:
			filteredParams.append(fParam)
			for fPP in filteredParams:
				newPV = fPP.Set(paramValue)
				newParamValue.append(newPV)
		else:
			newParamValue.append("Parameter Name not found, Try Again")
	
		
	


TransactionManager.Instance.TransactionTaskDone()
# Assign your output to the OUT variable.
OUT= elements, eParameters, ePString, filteredParam, filteredParams, newParamValue
# ----------------------------------------
code_block = CodeBlock(x=pre_select_elements_parameters) { x[0]; x[1]; x[2]; x[3]; x[4]; x[5]; }
watch = Watch(code_block.out0)  # graph output
watch_2 = Watch(code_block.out1)  # graph output
watch_3 = Watch(code_block.out2)  # graph output
watch_4 = Watch(code_block.out3)  # graph output
watch_5 = Watch(code_block.out4)  # graph output
watch_6 = Watch(code_block.out5)  # graph output
