# Dynamo graph MM - Title Block Area Fill.dyn (Dynamo 2.0.4.12684)

workpack_name_string = StringInput("")  # graph input
sheet_number_string = StringInput("Sheet Number")

# group: Collector.Filter String Contains DO NOT UPDATE OR TOUCH
code_block = CodeBlock(SearchValue=workpack_name_string) { SearchValue: string; }
code_block_2 = CodeBlock(Parameter=sheet_number_string) { Parameter: string; }
boolean = BoolSelector(false)  # graph input
python_filterstringcontains = Python(IN[0]=code_block, IN[1]=code_block_2, IN[2]=boolean)
# ---------- python_filterstringcontains.python (130 lines) ----------
import clr
import System

clr.AddReference("RevitServices")
import RevitServices
from RevitServices.Persistence import DocumentManager
from RevitServices.Transactions import TransactionManager
doc = DocumentManager.Instance.CurrentDBDocument

clr.AddReference("RevitAPI")
import Autodesk
from Autodesk.Revit.DB import *

clr.AddReference("RevitNodes")
import Revit
clr.ImportExtensions(Revit.Elements)
clr.ImportExtensions(Revit.GeometryConversion)

from System.Collections.Generic import List
string = IN[0]
case = IN[2]
search = IN[1]

bips = System.Enum.GetValues(BuiltInParameter)

bm = doc.ParameterBindings
bmlist = bm.ForwardIterator()
paramId = None
testout = []
while bmlist.MoveNext():
	binddef = bmlist.Key
	testout.append(binddef.Name)
	if binddef.Name == search:
		paramId = binddef.Id
		break

param = None
if paramId == None:
	biplist = []
	for bip in bips:
		try:
			name = LabelUtils.GetLabelFor(bip)
		except:
			continue
		if name == search:
			biplist.append(bip)

sharedparamrule = SharedParameterApplicableRule(search)

evaluator = FilterStringContains()
parameter = None
if paramId == None and len(biplist) == 0:
	coll = FilteredElementCollector(doc)
	sharedparams = coll.OfClass(ParameterElement)
	
	for param in sharedparams:
		name = param.GetDefinition().Name
		if name == search:
			parameter = param
	
	if parameter != None:
		ruleslist = List[FilterRule]()
		provider = ParameterValueProvider(parameter.Id)
		filterrule = FilterStringRule(provider, evaluator, string, case)
		ruleslist.Add(filterrule)
		ruleslist.Add(sharedparamrule)
		paramFilter = ElementParameterFilter(ruleslist)
		collector = FilteredElementCollector(doc)
		collector.OfClass(FamilyInstance).WherePasses(paramFilter)
		
		collector2 = FilteredElementCollector(doc)
		collector2.OfClass(HostObject).WherePasses(paramFilter)
		collector2.UnionWith(collector)

		
elif paramId == None:
	if len(biplist) == 1:
		provider = ParameterValueProvider(ElementId(biplist[0]))
		filterrule = FilterStringRule(provider, evaluator, string, case)
		paramFilter = ElementParameterFilter(filterrule)
		collector = FilteredElementCollector(doc)
		collector.OfClass(FamilyInstance).WherePasses(paramFilter)
		
		collector2 = FilteredElementCollector(doc)
		collector2.OfClass(HostObject).WherePasses(paramFilter)
		collector2.UnionWith(collector)
	else:
		provider = ParameterValueProvider(ElementId(biplist[0]))
		filterrule = FilterStringRule(provider, evaluator, string, case)
		paramFilter = ElementParameterFilter(filterrule)
		collector = FilteredElementCollector(doc)
		collector.OfClass(FamilyInstance).WherePasses(paramFilter)
		
		collector2 = FilteredElementCollector(doc)
		collector2.OfClass(HostObject).WherePasses(paramFilter)
		collector2.UnionWith(collector)
		for i,param in enumerate(biplist):
			if i == 0:
				continue
			provider = ParameterValueProvider(ElementId(param))
			filterrule = FilterStringRule(provider, evaluator, string, case)
			paramFilter = ElementParameterFilter(filterrule)
			tempcollector1 = FilteredElementCollector(doc)
			tempcollector1.OfClass(FamilyInstance).WherePasses(paramFilter)
			tempcollector2 = FilteredElementCollector(doc)
			tempcollector2.OfClass(HostObject).WherePasses(paramFilter)
			tempcollector2.UnionWith(tempcollector1)
			collector2.UnionWith(tempcollector2)
	
else:
	ruleslist = List[FilterRule]()
	provider = ParameterValueProvider(paramId)
	filterrule = FilterStringRule(provider, evaluator, string, case)
	ruleslist.Add(filterrule)
	ruleslist.Add(sharedparamrule)
	paramFilter = ElementParameterFilter(ruleslist)
	collector = FilteredElementCollector(doc)
	collector.OfClass(FamilyInstance).WherePasses(paramFilter)
	
	collector2 = FilteredElementCollector(doc)
	collector2.OfClass(HostObject).WherePasses(paramFilter)
	collector2.UnionWith(collector)



if parameter == None and paramId == None and len(biplist) == 0:
	OUT = "Does not work with non-shared family parameters"
else:
	elements = collector2.ToElements()
	OUT = elements
# ----------------------------------------
code_block_3 = CodeBlock(Elements=python_filterstringcontains) { Elements; }

string = StringInput("5A")  # graph input
getParameterValueByName = Element.GetParameterValueByName(element=code_block_3, parameterName=string)
number_slider = DoubleSlider(1, range=0..100 step 0.1)  # graph input
eq = getParameterValueByName == number_slider
filterByBoolMask = List.FilterByBoolMask(list=code_block_3, mask=eq)
number_slider_2 = DoubleSlider(0, range=0..100 step 0.1)  # graph input
setParameterByName = Element.SetParameterByName(element=filterByBoolMask.in, parameterName=string, value=number_slider_2)
string_2 = StringInput("6A")  # graph input
number_slider_3 = DoubleSlider(1, range=0..100 step 0.1)  # graph input
setParameterByName_2 = Element.SetParameterByName(element=setParameterByName, parameterName=string_2, value=number_slider_3)
