# Dynamo graph MM - Turn Off Worksets in Link.dyn (Dynamo 2.0.4.12684)

# group: Original Nodes MisterMEP - BIM360LinkPathInfo(isolated only BIM360Path using their code), GeniusLoci Manage Worksets of RevitLinkInstance (does not work for BIM360)
manage_worksets_of = Custom[Manage Worksets of RevitLinkInstance]()  # frozen; unwired: RevitLinkInstance, WorksetName
code_block = CodeBlock { RevitLinkType; }  # unwired: RevitLinkType
code_block_2 = CodeBlock { RevitLinkInstance; }  # unwired: RevitLinkInstance
code_block_3 = CodeBlock()  # unwired: WorksetName
# ---------- code_block_3.designscript (2 lines) ----------
//UserWorksetName or part of UserWorksetName to close
WorksetName : string[]..[];
# ----------------------------------------
manage_worksets_of_2 = Python(IN[0]=code_block_2, IN[1]=code_block_3)  # "Manage Worksets of RevitLinksInstance"; frozen
# ---------- manage_worksets_of_2.python (44 lines) ----------
import clr
# Import DocumentManager and TransactionManager
clr.AddReference("RevitServices")
import RevitServices
from RevitServices.Persistence import DocumentManager
from RevitServices.Transactions import TransactionManager
# Import RevitAPI
clr.AddReference("RevitAPI")
import Autodesk
from Autodesk.Revit.DB import *

docu = DocumentManager.Instance.CurrentDBDocument

def tolist(obj1):
    if hasattr(obj1,"__iter__"): return obj1
    else: return [obj1]

linkInstance = tolist(UnwrapElement(IN[0]))
worksetNames = tolist(IN[1])

doc = linkInstance[0].GetLinkDocument()

closedWks,openWks = [],[]

#Collect worksets
userWorksets = FilteredWorksetCollector(doc).OfKind(WorksetKind.UserWorkset).ToWorksets()
for userWks in userWorksets:
	wName=userWks.Name
	for wksName in worksetNames :
		if wksName.lower() in wName.lower() :
			closedWks.append(wName)
	if wName not in closedWks :
		openWks.append(userWks.Id)

#WorksetConfig=WorksetConfiguration()
WorksetConfig=WorksetConfiguration(WorksetConfigurationOption.CloseAllWorksets)
WorksetConfig.Open(openWks)

TransactionManager.Instance.ForceCloseTransaction()
RevitLinkType = docu.GetElement(linkInstance[0].GetTypeId())
filepath = RevitLinkType.GetExternalFileReference().GetAbsolutePath()
RevitLinkType.LoadFrom(filepath,WorksetConfig)

OUT = RevitLinkType,closedWks
# ----------------------------------------
code_block_4 = CodeBlock(x=manage_worksets_of_2) { x[0]; x[1]; }
code_block_5 = CodeBlock(ClosedWorkset=code_block_4.out1) { ClosedWorkset; }
BIM360LinkPathInfo = Custom[BIM360LinkPathInfo]()  # frozen

links = Links(index=20)

# group: Collect Link/s Worksets, remove Nulls
get_user_worksets = Python(IN[0]=links)
# ---------- get_user_worksets.python (28 lines) ----------
import clr
clr.AddReference('RevitAPI')
from Autodesk.Revit.DB import *
import Autodesk

clr.AddReference("RevitServices")
import RevitServices
from RevitServices.Persistence import DocumentManager

#Part of script from Clockwork
inputdoc = UnwrapElement(IN[0])
if inputdoc == None:
	doc = DocumentManager.Instance.CurrentDBDocument
elif inputdoc.GetType().ToString() == "Autodesk.Revit.DB.RevitLinkInstance":
	doc = inputdoc.GetLinkDocument()
elif inputdoc.GetType().ToString() == "Autodesk.Revit.DB.Document":
	doc = inputdoc
else: doc = None

names = []
#Collect worksets
userWorksets = FilteredWorksetCollector(doc).OfKind(WorksetKind.UserWorkset).ToWorksets()
for userWorkset in userWorksets:
	names.append(userWorkset.Name)
	

#Assign your output to the OUT variable
OUT =  names
# ----------------------------------------
uniqueItems = List.UniqueItems(list=get_user_worksets)
string_from_object = FromObject(obj=uniqueItems)

# group: Get any string containing this text - ignore case so write how it will never look, in will be all names of worksets you want closed. Set Difference gets list of all worksets you want on.
code_block_6 = CodeBlock { ["LeVeL","GrId","HiDdEn","LvL","sCoPe","lInK"]; }
boolean = BoolSelector(true)
contains = String.Contains(str=string_from_object, searchFor=code_block_6@L1, ignoreCase=boolean)
filterByBoolMask = List.FilterByBoolMask(list=string_from_object, mask=contains@L2)
uniqueItems_2 = List.UniqueItems(list=filterByBoolMask.in)
flatten = List.Flatten(list=uniqueItems_2)

passthrough = Custom[Passthrough](passThrough=links, waitFor=flatten)  # Forces a sequential order of execution. The node wired into the output of the Passthrough node will be executed *after* the node wired into the waitFor input (e.g. important for some Revit operations). The value of the passThrough input will be passed on to the node wired into the output port of the Passthrough node.

# group: Flatten input lists, input names (from Hijacked code, original node below. GeniusLoci Manage Worksets of RevitLinkInstance)
flatten_2 = List.Flatten(list=passthrough)
code_block_7 = CodeBlock(RevitLinkInstance=flatten_2) { RevitLinkInstance; }
code_block_8 = CodeBlock(WorksetName=flatten)  # same code as code_block_3

manage_worksets_of_3 = Python(IN[0]=code_block_7, IN[1]=code_block_8)  # "Manage Worksets of RevitLinksInstance"; unwired: IN[2]
# ---------- manage_worksets_of_3.python (54 lines) ----------
import clr
# Import DocumentManager and TransactionManager
clr.AddReference("RevitServices")
import RevitServices
from RevitServices.Persistence import DocumentManager
from RevitServices.Transactions import TransactionManager
# Import RevitAPI
clr.AddReference("RevitAPI")
import Autodesk
from Autodesk.Revit.DB import *

docu = DocumentManager.Instance.CurrentDBDocument

def tolist(obj1):
    if hasattr(obj1,"__iter__"): return obj1
    else: return [obj1]

linkInstance = tolist(UnwrapElement(IN[0]))
worksetNames = tolist(IN[1])
bIM360FilePaths = tolist(UnwrapElement(IN[2]))
doc = linkInstance[0].GetLinkDocument()

closedWks,openWks = [],[]

#Collect worksets
userWorksets = FilteredWorksetCollector(doc).OfKind(WorksetKind.UserWorkset).ToWorksets()
for userWks in userWorksets:
	wName=userWks.Name
	for wksName in worksetNames :
		if wksName.lower() == wName.lower() :
			closedWks.append(wName)
	if wName not in closedWks :
		openWks.append(userWks.Id)

#WorksetConfig=WorksetConfiguration()
WorksetConfig=WorksetConfiguration(WorksetConfigurationOption.CloseAllWorksets)
WorksetConfig.Open(openWks)

TransactionManager.Instance.ForceCloseTransaction()
RevitLinkType = docu.GetElement(linkInstance[0].GetTypeId())
filepath = RevitLinkType.GetExternalResourceReferences()
keys = filepath.Keys
references = []

for key in keys:
	reference = filepath[key]
	references.append(reference)
	


RevitLinkType.LoadFrom(references[0],WorksetConfig)

OUT = RevitLinkType,closedWks
#OUT = references
# ----------------------------------------

# group: Split output to list, output name
code_block_9 = CodeBlock(x=manage_worksets_of_3) { x[0]; x[1]; }
code_block_10 = CodeBlock(RevitLinkInstance=code_block_9.out0) { RevitLinkInstance; }
code_block_11 = CodeBlock(ClosedWorkset=code_block_9.out1) { ClosedWorkset; }

watch = Watch(code_block_10)
watch_2 = Watch(code_block_11)
manage_worksets_of_4 = Custom[Manage Worksets of RevitLinkInstance]()  # unwired: RevitLinkInstance, WorksetName
